# Grasshopper definition plotarea PolygonArea Direction.gh (Grasshopper 1.0.8)
# plug-ins: Kangaroo2 Components

number_slider = Slider(70, range=0..100)
number_slider_2 = Slider(28, range=0..100)
number_slider_3 = Slider(72, range=0..100)
number_slider_4 = Slider(86, range=0..100)
crv = Curve([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])
# https://discourse.mcneel.com/t/plot-subdivision-area-optimization-problem/139117/14?u=quan_li
crv_2 = Curve(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)
area = Area(Geometry=crv_2)  # -> Area, Centroid
ma = MassAddition(Input=[number_slider_2, number_slider_3, number_slider, number_slider_4])  # -> Result, PartialResults
explode = Explode(Curve=crv, Recursive=True)  # -> Segments, Vertices
pt = Point([Point(10, 20.5, 0), Point(10, 10, 0), Point(20, 10, 0), Point(30, 10, 0), Point(30, 20.5, 0), Point(30, 30, 0), Point(20, 30, 0), Point(10, 30, 0)])
subtraction = Subtraction(A=area.Area, B=ma.Result)

oncurve = OnCurve(Points=pt, Curve=crv_2, Strength=1)
polygonarea = PolygonArea(Polyline=crv, Area=[number_slider_2, number_slider_3, number_slider, number_slider_4, subtraction], Strength=1)
show = Show(G=crv)
direction = Direction(Line=explode.Segments, Strength=1)
grab = Grab(On=True, Strength=1, Range=3)

entwine = Entwine(Branch00=show, Branch01=[direction, oncurve, polygonarea, grab], FlattenInputs=True)
solver = Solver(GoalObjects=entwine, Reset=Button(), Threshold=1e-15, Tolerance=0.0001, On=True)  # -> I, V, O
bang = ExplodeTree(Data=solver.O)  # -> Branch0, Branch1
crv_3 = Curve(bang.Branch0)
area_2 = Area(Geometry=crv_3)  # -> Area, Centroid
expression = Expression(x=area_2.Area, Expression="Format(\"{0:0.000}\", x)")
tag = TextTag(Location=area_2.Centroid, Text=expression)
