# Grasshopper definition Ngon Mesh Panelization CoPlanar Rod.gh (Grasshopper 1.0.8)
# plug-ins: Kangaroo2 Components

brep = Brep(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)
triremesh = TriRemesh(Geometry=brep, Length=3, Iterations=25)  # -> Triangulation, Dual, Creases

# ---- group: ngon mesh
mesh = Mesh(triremesh.Dual)

# ---- group: ngon boundary polylines
faceb = FaceBoundaries(Mesh=mesh)

# ---- group: start with this low, then slide up
number_slider = Slider(5.104, range=1..15)

# ----
explode = Explode(Curve=faceb, Recursive=True)  # -> Segments, Vertices
demesh = DeconstructMesh(Mesh=mesh)  # -> Vertices, Faces, Colours, Normals
end = EndPoints(Curve=explode.Segments)  # -> Start, End
_10º = PowerOf10(Value=number_slider)
panel = Panel("CoPlanar Rod")

coplanar = CoPlanar(Points=end.Start, Strength=_10º)
show = Show(G=faceb)
rod = Rod(Polyline=faceb, LengthFactor=1, AngleFactor=1, AxialStrength=1, BendStrength=1)  # -> flatten(R)
anchor = Anchor(Point=demesh.Vertices, Strength=10)

entwine = Entwine(Branch00=show, Branch01=[coplanar, anchor, rod], FlattenInputs=True)
reset = Button()
on = BooleanToggle(False)
solver = Solver(GoalObjects=entwine, Reset=reset, Threshold=1e-15, Tolerance=0.0001, On=on)  # -> I, V, O
bang = ExplodeTree(Data=solver.O)  # -> Branch0, Branch1
boundary = BoundarySurfaces(Edges=bang.Branch0)
