# Grasshopper definition Hex_Planarization LaplacianSmooth AngleSum CoPlanar .gh (Grasshopper 1.0.8)
# plug-ins: Kangaroo2 Components, Nautilus

crv = Curve([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])
# https://discourse.mcneel.com/t/planarize-cells-coming-from-kangaroo-simulation/109855/4?u=quan_li
explode = Explode(Curve=crv, Recursive=True)  # -> flatten(Segments), Vertices
disc = Discontinuity(Curve=crv, Level=1)  # -> Points, Parameters
pt = Point(disc.Points)
avr = Average(Input=pt)
pdecon = Deconstruct(Point=disc.Points)  # -> XComponent, YComponent, flatten(ZComponent)
tri_fan_polyline = TriFanPolyline(P=crv)
dupln = RemoveDuplicateLines(Lines=flatten(explode.Segments), Tolerance=0.01)
smaller = SmallerThan(FirstNumber=pdecon.ZComponent, SecondNumber="0.1")  # -> SmallerThan, OrEqualTo
smesh = SimpleMesh(Brep=tri_fan_polyline)
pshift = ShiftPaths(Data=tri_fan_polyline, Offset=-1)
linestopology = LinesTopology(Lines=dupln, Tolerance=0.01, Method=True)  # -> Points, LinePoints, PointPoints, PointLines
pshift_2 = ShiftPaths(Data=smesh, Offset=-1)
disc_2 = Discontinuity(Curve=pshift, Level=1)  # -> Points, Parameters
cull = CullPattern(List=flatten(disc.Points), CullPattern=smaller.SmallerThan)
clean = CombineClean(Meshes=pshift_2)  # -> flatten(Mesh)
pshift_3 = ShiftPaths(Data=disc_2.Points, Offset=-1)
ln = Line(StartPoint=avr, EndPoint=pt)
item = ListItem(List=linestopology.Points, Index=linestopology.PointPoints, Wrap=True)
lng = ListLength(List=linestopology.PointPoints)
duppt = RemoveDuplicatePts(Points=cull, Tolerance=0.01)
equals = Equality(FirstNumber=lng, SecondNumber="3")  # -> Equality, Inequality
duppt_2 = RemoveDuplicatePts(Points=disc.Points, Tolerance=0.01)
Z = UnitZ(Factor=Slider(0.064, range=0..1))
_10º = PowerOf10(Value=Slider(9, range=0..10))

# ----
# LaplacianSmooth AngleSum CoPlanar Load
laplaciansmooth = CSharpScript(
    Centre=simplify(graft(linestopology.Points)),
    Neighbours=item,
    Strength=Slider(9.647, range=0..21),
    Reference="C:\Program Files\Rhino 8\Plug-ins\Grasshopper\Components\KangarooSolver.dll")  # -> out, flatten(A); inputs Centre: Point3d, Neighbours: list of Point3d, Strength: Double
# ---------- laplaciansmooth: C# ----------
    List<Point3d> pts = new List<Point3d>();
    pts.Add(Centre);
    pts.AddRange(Neighbours);
    A = new KangarooSolver.Goals.LaplacianSmooth(pts.ToArray(), Strength);
# ---------- end laplaciansmooth ----------
length_line = LengthLine(Line=explode.Segments, Strength=0.1)
anchor = Anchor(Point=duppt_2, Strength=0.1)
anchor_2 = Anchor(Point=duppt, Strength=1000)
coplanar = CoPlanar(Points=disc.Points, Strength=_10º)
show = Show(G=clean)
anglesum = CSharpScript(P=pshift_3, k=1, Reference="C:\PROGRAM FILES\RHINO 8\PLUG-INS\GRASSHOPPER\COMPONENTS\KangarooSolver.dll")  # -> out, A; inputs P: list of Point3d, k: Double
# ---------- anglesum: C# usings ----------
using System.IO;
using System.Linq;
using System.Data;
using System.Drawing;
using System.Reflection;
using System.Windows.Forms;
using System.Xml;
using System.Xml.Linq;
using System.Runtime.InteropServices;

using Rhino.DocObjects;
using Rhino.Collections;
using GH_IO;
using GH_IO.Serialization;
using KangarooSolver;
using KangarooSolver.Goals;
# ---------- anglesum: C# ----------
    A = new AngleSum(P.ToArray(), Math.PI * 2, k);
# ---------- anglesum: C# additional code ----------
  public class AngleSum : GoalObject
  {
    double targetSum;
    public AngleSum(Point3d[] pts, double targetSum, double strength)
    {
      PPos = pts;
      Move = new Vector3d[pts.Length];
      Weighting = new double[pts.Length];
      for(int i = 0;i < pts.Length;i++) Weighting[i] = strength;
      this.targetSum = targetSum;
    }

    public override void Calculate(List<KangarooSolver.Particle> p)
    {

      //take sets of 3 points
      //find angles
      //get total angle and required change
      //for each angle,
      //get intersection of bisector with line between arm ends
      //move angle pt along vector to this

      var pts = this.GetCurrentPositions(p);
      for(int i = 0;i < pts.Length;i++)Move[i] = Vector3d.Zero;


      double[] angles = new double[pts.Length / 3];
      double angleSum = 0;

      for(int i = 0;i < pts.Length;i += 3)
      {
        Point3d apex = pts[i];
        Point3d endA = pts[i + 1];
        Point3d endB = pts[i + 2];
        double angle = Vector3d.VectorAngle(endA - apex, endB - apex);
        angles[i / 3] = angle;
        angleSum += angle;
      }


      double m = targetSum / angleSum;

      for(int i = 0;i < pts.Length;i += 3)
      {
        Point3d apex = pts[i];
        Point3d endA = pts[i + 1];
        Point3d endB = pts[i + 2];

        Vector3d va = endA - apex;
        Vector3d vb = endB - apex;
        va.Unitize();
        vb.Unitize();
        Line bisector = new Line(apex, va + vb);
        Line ab = new Line(endA, endB);
        double ta,tb;
        Rhino.Geometry.Intersect.Intersection.LineLine(ab, bisector, out ta, out tb, 0, false);
        Vector3d v = apex - bisector.PointAt(tb);

        Move[i] += v * 0.1 * (1.0 - m);
      }



    }

    public override object Output(List < KangarooSolver.Particle > p)
    {
      return null;
    }
  }
# ---------- end anglesum ----------
length_line_2 = LengthLine(Line=ln, Length=0, Strength=0.01)

load = Load(Point=duppt_2, ForceVector=Z, Weighting=1)
cull_2 = CullPattern(List=laplaciansmooth.A, CullPattern=flatten(equals.Equality))
entwine = Entwine(
    Branch00=show,
    Branch01=[anchor_2, length_line, coplanar, cull_2, anchor, load, anglesum.A, length_line_2],
    FlattenInputs=True)
reset = Button()
solver = Solver(GoalObjects=entwine, Reset=reset, Threshold=1e-15, Tolerance=0.01, On=Toggle(True))  # -> I, V, O
bang = ExplodeTree(Data=solver.O)  # -> Branch0, Branch1
mesh = Mesh(bang.Branch0)
lng_2 = ListLength(List=mesh)
medges = MeshEdges(Mesh=mesh)  # -> NakedEdges, InteriorEdges, NonManifoldEdges
unweld = UnweldMesh(Mesh=mesh, Angle=0)
random = Random(Range=Domain(0, 1), Number=lng_2, Seed=2)
crv_2 = Curve(medges.NakedEdges)
gradient = Gradient(
    LowerLimit=0,
    UpperLimit=1,
    Parameter=random,
    stops=[0: RGB(255, 255, 255), 0.547: RGB(255, 192, 128), 1: RGB(216, 191, 216)])
join = JoinCurves(Curves=crv_2, Preserve=False)
boundary = BoundarySurfaces(Edges=join)
preview = CustomPreview(Geometry=unweld, Material=gradient)

# ==== cluster TriFanPolyline: Tri Fan Polyline
# Created By Quan Li
# 
# https://discourse.mcneel.com/u/quan_li/summary
# https://www.instagram.com/mearisori/
# @Yanji, Jilin, China
P = ClusterInput()  # Polyline
crv = Curve(P)
disc = Discontinuity(Curve=crv, Level=1)  # -> Points, Parameters
pt = Point(disc.Points)
avr = Average(Input=pt)
lng = ListLength(List=pt)
shift = ShiftList(List=disc.Points, Shift=expr("0", 1), Wrap=True)
shift_2 = ShiftList(List=disc.Points, Shift=1, Wrap=True)
dup = DuplicateData(Data=avr, Number=lng, Order=True)
merge = Merge(Data1=graft(shift), Data2=graft(shift_2), Data3=graft(dup))
pline = PolyLine(Vertices=merge, Closed=invert(False))
P_2 = ClusterOutput(pline)  # Polyline
