# Grasshopper definition Quad_Mesh_Planarization 01 SoapFilm EdgeLength OnCurve Planarize.gh (Grasshopper 1.0.8)
# plug-ins: Weaverbird, Kangaroo2 Components

mesh = Mesh(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)
wbcatmullclark = WeaverbirdsCatmullClarkSubdivision(MeshCurves=mesh, Level=2, SmoothNakedEdges=0)
medges = MeshEdges(Mesh=mesh)  # -> NakedEdges, InteriorEdges, NonManifoldEdges
mc = MeshCorners(Mesh=mesh, Angle=2.35619449)
diag = Diagonalize(Mesh=wbcatmullclark)
join = JoinCurves(Curves=medges.NakedEdges, Preserve=False)
tri = Triangulate(Mesh=diag)  # -> Mesh, Count
nv = NakedVertices(Mesh=diag)  # -> ClothedIndex, NakedIndex, ClothedPts, NakedPts
_10º = PowerOf10(Value=Slider(3, range=0..10))

# ----
# SoapFilm EdgeLength OnCurve Planarize
sg = SoapFilm(Mesh=tri.Mesh, Strength=1)
edgelengths = EdgeLengths(Mesh=diag, LengthFactor=0, Strength=0.1)
show = Show(G=diag)
oncurve = OnCurve(Points=nv.NakedPts, Curve=join, Strength=100)
anchor = Anchor(Point=mc, Strength=10000)
planarize = Planarize(M=diag, Strength=_10º)

entwine = Entwine(Branch00=show, Branch01=[anchor, edgelengths, oncurve, planarize, sg], FlattenInputs=True)
solver = Solver(GoalObjects=entwine, Reset=Button(), Threshold=1e-15, Tolerance=0.01, On=Toggle(False))  # -> I, V, O
bang = ExplodeTree(Data=solver.O)  # -> Branch0, Branch1
faceb = FaceBoundaries(Mesh=bang.Branch0)
boundary = BoundarySurfaces(Edges=faceb)
