# Grasshopper definition Quad_Mesh_Planarization 02 Smooth EqualLength ClamLength PlasticAnchor Planarize .gh (Grasshopper 1.0.8)
# plug-ins: Kangaroo2 Components

mesh = Mesh(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)
clean = CombineClean(Meshes=mesh)
faceb = FaceBoundaries(Mesh=clean)
explode = Explode(Curve=faceb, Recursive=True)  # -> Segments, Vertices
# Start with this low while editing, then
# increase to ensure the final form is fully
# planarized
planarize = Slider(7.126, range=1.5..15)
medges = MeshEdges(Mesh=clean)  # -> NakedEdges, InteriorEdges, NonManifoldEdges
demesh = DeconstructMesh(Mesh=clean)  # -> Vertices, Faces, Colours, Normals
item = ListItem(List=explode.Vertices, Index=0, Wrap=True)  # -> Item, Item1, Item2, Item3
ln = Line(StartPoint=item.Item1, EndPoint=item.Item3)
ln_2 = Line(StartPoint=item.Item, EndPoint=item.Item2)
_10º = PowerOf10(Value=planarize)
pt = Point([Point(2.86096859, 11.99963951, 6.965034962), Point(6.308836937, 45.94126129, 6.74011898), Point(8.175953865, 48.13757324, 3.912028313), Point(5.413661957, 42.90090179, 4.901660919), Point(4.286456108, 9.592967033, 4.901660919), Point(2.59252739, 15.18432045, 4.901660919)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])
pt_2 = Point([Point(27.02140427, 37.3081131, 0), Point(27.45949936, 35.22163391, 0), Point(28.47501373, 33.37269211, 0), Point(18.56481171, 29.61532402, 0), Point(17.97564697, 31.92157173, 0), Point(16.89022446, 34.09225082, 0)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])

planarize_2 = Planarize(M=clean, Strength=_10º)
panel = Panel(_10º)
smooth = Smooth(M=clean, Strength=3)
equallength = EqualLength(Line=[ln_2, ln], Strength=0.2)
plasticanchor = PlasticAnchor(Point=demesh.Vertices, Limit=0.03, Strength=0.4)
clamplength = ClampLength(Line=medges.InteriorEdges, LowerLimit=1, UpperLimit=10, Strength=1)
anchor = Anchor(Point=[pt, pt_2], Strength=1000)
show = Show(G=clean)
grab = Grab(On=Toggle(True), Strength=1, Range=3)  # -> Grab, Anchors

merge = Merge(
    Data1=flatten(show),
    Data2=flatten(planarize_2),
    Data3=flatten([anchor, smooth, equallength, plasticanchor, clamplength, grab.Grab]))
solver = Solver(GoalObjects=merge, Reset=Button(), Threshold=1e-15, Tolerance=0.01, On=Toggle(False))  # -> I, V, O
split = SplitList(List=solver.O, Index=1)  # -> ListA, ListB
dam = DataDam(DataA=split.ListA, BufferDelay=10000000, BufferMode=0)
mesh_2 = Mesh(split.ListA)
demesh_2 = DeconstructMesh(Mesh=mesh_2)  # -> Vertices, Faces, Colours, Normals
faceb_2 = FaceBoundaries(Mesh=dam)
deface = DeconstructFace(Face=graft(demesh_2.Faces))  # -> CornerA, CornerB, CornerC, CornerD
split_2 = SplitList(List=split.ListB, Index=1400)  # -> ListA, ListB
boundary = BoundarySurfaces(Edges=faceb_2)
gradient = Gradient(
    LowerLimit=0,
    UpperLimit=0.05,
    Parameter=split_2.ListA,
    stops=[0: RGB(0, 128, 0), 0.5: RGB(255, 255, 0), 1: RGB(255, 0, 0)])
item_2 = ListItem(List=demesh_2.Vertices, Index=[deface.CornerA, deface.CornerB, deface.CornerC, deface.CornerD], Wrap=True)
conmesh = ConstructMesh(Vertices=item_2, Faces={A=0, B=1, C=2, D=3})  # -> flatten(Mesh)
material = CreateMaterial(Diffuse=gradient, Specular=RGB(255, 255, 255), Emission=RGB(0, 0, 0), Transparency=0, Shine=0)
preview = CustomPreview(Geometry=conmesh, Shader=material)
