# Grasshopper definition MeshMap MeshMap.gh (Grasshopper 1.0.7)
# plug-ins: Kangaroo2 Components

mesh = Mesh(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)
mesh_2 = Mesh(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)
mesh_3 = Mesh(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)
demesh = DeconstructMesh(Mesh=mesh_3)  # -> Vertices, Faces, Colours, Normals
meshmap = MeshMap(SourceMesh=mesh, TargetMesh=mesh_2, Point=demesh.Vertices, Distance=1)
conmesh = ConstructMesh(Vertices=meshmap, Faces=demesh.Faces)
