# Grasshopper definition moebiushexplanar 2.gh (Grasshopper 1.0.7)
# plug-ins: Kangaroo2 Components

cell_size = Slider(10, range=0..30)
cells_in_y = Slider(15, range=0..30)
cells_in_x = Slider(18, range=0..30)
expression = Expression(c=cell_size, Expression="c/sqrt(3)")
hexgrid = Hexagonal(Plane=PlaneXY(0, 0, 0), Size=expression, ExtentX=cells_in_x, ExtentY=cells_in_y)  # -> Cells, Points
pcen = PolygonCenter(Polyline=hexgrid.Cells)  # -> flatten(CenterV), CenterE, CenterA
avr = Average(Input=pcen.CenterV)
cp = ClosestPoint(Point=avr, Cloud=pcen.CenterV)  # -> ClosestPoint, CPIndex, Distance
rev = Reverse(Vector=cp.ClosestPoint)
move = Move(Geometry=hexgrid.Cells, Motion=rev)  # -> Geometry, Transform
pcen_2 = PolygonCenter(Polyline=move.Geometry)  # -> CenterV, CenterE, CenterA
pi = Pi(Factor="0.5")
xy = XYPlane(Origin=pcen_2.CenterV)
toggle = BooleanToggle(True)
cir = Circle(Plane=PlaneXY(0, 0, 0), Radius=Slider(36.086, range=0..100))
mb = MöbiusTransformation(Geometry=xy, Circle=cir, T=pi, Q=0, FixSphere=False)
mb_2 = MöbiusTransformation(Geometry=move.Geometry, Circle=cir, T=pi, Q=Slider(0.52, range=0..1), FixSphere=False)  # -> flatten(Geometry)
polygon = Polygon(Plane=mb, Radius=Slider(5, range=0..5), Segments=6, FilletRadius=0)  # -> Polygon, Length
