# Grasshopper definition moebiushexplanar.gh (Grasshopper 1.0.7)
# plug-ins: Kangaroo2 Components

ex = ExtentX(21)
hexgrid = Hexagonal(Plane=PlaneXY(0, 0, 0), Size=1, ExtentX=ex, ExtentY=ex)  # -> Cells, Points
pcen = PolygonCenter(Polyline=hexgrid.Cells)  # -> flatten(CenterV), CenterE, CenterA
avr = Average(Input=pcen.CenterV)
cp = ClosestPoint(Point=avr, Cloud=pcen.CenterV)  # -> ClosestPoint, CPIndex, Distance
rev = Reverse(Vector=cp.ClosestPoint)
move = Move(Geometry=hexgrid.Cells, Motion=rev)  # -> Geometry, Transform
cir = Circle(Plane=PlaneXY(0, 0, 0), Radius=Slider(10.752, range=0..21))
pi = Pi(Factor=Slider(0.5, range=0..1))
mb = MöbiusTransformation(Geometry=move.Geometry, Circle=cir, T=pi, Q=0, FixSphere=False)
boundary = BoundarySurfaces(Edges=mb)
