# Grasshopper definition colourtension ShrinkByColour.gh (Grasshopper 1.0.7)
# plug-ins: Kangaroo2 Components, Flexibility

W = WidthCount(110)
B = Boundary({Plane=PlaneXY(0, 0, 0), Size=Domain2(u=-10..10, v=-10..10)})
mplane = MeshPlane(Boundary=B, WidthCount=W, HeightCount=W)  # -> Mesh, Area
warpweft = WarpWeft(Mesh=mplane.Mesh)  # -> Warp, Weft, NakedA, NakedB
img = ImportImage(File="C:\Users\meari\Desktop\robert_de_niro_new_york_1993.jpg", Rectangle=B)
nv = NakedVertices(Mesh=mplane.Mesh)  # -> ClothedIndex, NakedIndex, ClothedPts, NakedPts
merge = Merge(Data1=warpweft.Warp, Data2=warpweft.Weft)
join = JoinCurves(Curves=warpweft.Weft, Preserve=False)
join_2 = JoinCurves(Curves=warpweft.Warp, Preserve=False)

anchor = Anchor(Point=nv.NakedPts, Strength=10000)
show = Show(G=join_2)
shrinkbycolour_goal = ShrinkByColour(
    L=merge,
    M=img,
    invert=0,
    strength=1,
    Reference="C:\Program Files\Rhino 7\Plug-ins\Grasshopper\Components\KangarooSolver.dll")  # -> out, A; inputs L: list of Line, M: Mesh, invert: Boolean, strength: Double
# ---------- shrinkbycolour_goal: C# usings ----------
using System.IO;
using System.Linq;
using System.Data;
using System.Drawing;
using System.Reflection;
using System.Windows.Forms;
using System.Xml;
using System.Xml.Linq;
using System.Runtime.InteropServices;

using Rhino.DocObjects;
using Rhino.Collections;
using GH_IO;
using GH_IO.Serialization;
using KPlankton;
using KangarooSolver;
using KangarooSolver.Goals;
# ---------- shrinkbycolour_goal: C# ----------
    var goals = new ShrinkByColour[L.Count];

    for(int i = 0;i < L.Count;i++) goals[i] = new ShrinkByColour(L[i].From, L[i].To, M, strength, invert);
    A = goals;
# ---------- shrinkbycolour_goal: C# additional code ----------
  public class ShrinkByColour : GoalObject
  {
    Mesh M;
    double L;
    bool invert;
    public ShrinkByColour(Point3d s, Point3d e, Mesh M, double k, bool invert)
    {
      PPos = new Point3d[2] { s, e }; //initial positions
      Move = new Vector3d[2];
      this.M = M;
      L = s.DistanceTo(e);
      Weighting = new double[2]{k / L,k / L};
      this.invert = invert;
    }

    public override void Calculate(List<KangarooSolver.Particle> p)
    {
      var positions = this.GetCurrentPositions(p);
      var startPt = positions[0];
      var endPt = positions[1];
      Point3d midPt = 0.5 * (startPt + endPt);
      Color c = M.ColorAt(M.ClosestMeshPoint(midPt, 0));
      double colorval = invert ? 1.0 - (c.R / 255.0) : c.R / 255.0;

      Move[0] = (midPt - startPt) * (1.0 - 0.8 * colorval);
      Move[1] = -Move[0];
    }

    public override object Output(List<KangarooSolver.Particle> p)
    {
      return new Line(p[PIndex[0]].Position, p[PIndex[1]].Position);
    }
  }
# ---------- end shrinkbycolour_goal ----------
show_2 = Show(G=join)

entwine = Entwine(Branch00=show, Branch01=show_2, Branch02=[shrinkbycolour_goal.A, anchor], FlattenInputs=True)
solver = Solver(GoalObjects=entwine, Reset=Button(), Threshold=1e-15, Tolerance=0.01, On=Toggle(False))  # -> I, V, O
bang = ExplodeTree(Data=solver.O)  # -> Branch0, Branch1, Branch2
crv = Curve(bang.Branch0)
crv_2 = Curve(bang.Branch1)
curvepreview = CurvePreview(Curve=crv, Width=2, Color=ColourSwatch(SwatchColor=RGB(0, 0, 0)), Mode=0)
curvepreview_2 = CurvePreview(Curve=crv_2, Width=2, Color=ColourSwatch(SwatchColor=RGB(0, 0, 0)), Mode=0)
