# Grasshopper definition spiral_img ShrinkByColour.gh (Grasshopper 1.0.7)
# plug-ins: Kangaroo2 Components

range = Range(Domain=Domain(0, 1), Steps=500)
multiplication = Multiplication(A="330", B=range)
multiplication_2 = Multiplication(A=10, B=range)
pt = PointPolar(BasePlane=PlaneXY(0, 0, 0), XYAngle=multiplication, ZAngle=0, Offset=multiplication_2)
intcrv = Interpolate(Vertices=pt, Degree=3, Periodic=False, KnotStyle=1)  # -> Curve, Length, Domain
B = Boundary({Plane=PlaneXY(0, 0, 0), Size=Domain2(u=-10..10, v=-10..10)})
W = WidthCount(110)
img = ImportImage(File="C:\Users\meari\Desktop\testPicture.jpeg", Rectangle=B)
divide = DivideCurve(Curve=intcrv.Curve, Count="8000", Kinks=False)  # -> Points, Tangents, Parameters
mplane = MeshPlane(Boundary=B, WidthCount=W, HeightCount=W)  # -> Mesh, Area
pline = PolyLine(Vertices=divide.Points, Closed=False)
del = DelaunayMesh(Points=divide.Points, Plane=PlaneXY(0, 0, 0))
explode = Explode(Curve=pline, Recursive=True)  # -> Segments, Vertices
nv = NakedVertices(Mesh=del)  # -> ClothedIndex, NakedIndex, ClothedPts, NakedPts
length_line = LengthLine(Line=explode.Segments, Length=0, Strength=2)
medges = MeshEdges(Mesh=del)  # -> NakedEdges, InteriorEdges, NonManifoldEdges
vn = VertexNeighbours(Mesh=del, VertexNumber=nv.NakedIndex)  # -> Vertex, Neighbours, Normal
data = Data(nv.NakedPts)
relay = Relay([medges.InteriorEdges, medges.NakedEdges])
duppt = RemoveDuplicatePts(Points=flatten([vn.Neighbours, vn.Vertex]), Tolerance=0.01)
shrinkbycolour_goal = ShrinkByColour(
    L=relay,
    M=img,
    invert=Toggle(False),
    strength=1,
    Reference="C:\Program Files\Rhino 7\Plug-ins\Grasshopper\Components\KangarooSolver.dll")  # -> out, A; inputs L: list of Line, M: Mesh, invert: Boolean, strength: Double
# ---------- shrinkbycolour_goal: C# usings ----------
using System.IO;
using System.Linq;
using System.Data;
using System.Drawing;
using System.Reflection;
using System.Windows.Forms;
using System.Xml;
using System.Xml.Linq;
using System.Runtime.InteropServices;

using Rhino.DocObjects;
using Rhino.Collections;
using GH_IO;
using GH_IO.Serialization;
using KPlankton;
using KangarooSolver;
using KangarooSolver.Goals;
# ---------- shrinkbycolour_goal: C# ----------
    var goals = new ShrinkByColour[L.Count];

    for(int i = 0;i < L.Count;i++) goals[i] = new ShrinkByColour(L[i].From, L[i].To, M, strength, invert);
    A = goals;
# ---------- shrinkbycolour_goal: C# additional code ----------
  public class ShrinkByColour : GoalObject
  {
    Mesh M;
    double L;
    bool invert;
    public ShrinkByColour(Point3d s, Point3d e, Mesh M, double k, bool invert)
    {
      PPos = new Point3d[2] { s, e }; //initial positions
      Move = new Vector3d[2];
      this.M = M;
      L = s.DistanceTo(e);
      Weighting = new double[2]{k / L,k / L};
      this.invert = invert;
    }

    public override void Calculate(List<KangarooSolver.Particle> p)
    {
      var positions = this.GetCurrentPositions(p);
      var startPt = positions[0];
      var endPt = positions[1];
      Point3d midPt = 0.5 * (startPt + endPt);
      Color c = M.ColorAt(M.ClosestMeshPoint(midPt, 0));
      double colorval = invert ? 1.0 - (c.R / 255.0) : c.R / 255.0;

      Move[0] = (midPt - startPt) * (1.0 - 0.8 * colorval);
      Move[1] = -Move[0];
    }

    public override object Output(List<KangarooSolver.Particle> p)
    {
      return new Line(p[PIndex[0]].Position, p[PIndex[1]].Position);
    }
  }
# ---------- end shrinkbycolour_goal ----------
anchor = Anchor(Point=duppt, Strength=10000)
show = Show(G=divide.Points)
entwine = Entwine(Branch00=show, Branch01=[anchor, length_line, shrinkbycolour_goal.A], FlattenInputs=True)
solver = Solver(GoalObjects=entwine, Reset=Button(), Threshold=1e-15, Tolerance=0.01, On=Toggle(False))  # -> I, V, O
bang = ExplodeTree(Data=solver.O)  # -> Branch0, Branch1
pt_2 = Point(solver.V)
pline_2 = PolyLine(Vertices=bang.Branch0, Closed=False)
