# Grasshopper definition SplitAtCorners.gh (Grasshopper 1.0.7)
# plug-ins: Kangaroo2 Components

# Note that the angle is between consecutive segments in the same direction. So 0 is a straight line
number_slider = Slider(0.784, range=0..3.141)
B = Boundary({Plane=PlaneXY(0, 0, 0), Size=Domain2(u=-10..10, v=-10..10)})
mplane = MeshPlane(Boundary=B, WidthCount=10, HeightCount=10)  # -> Mesh, Area
crv = Curve(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)
medges = MeshEdges(Mesh=mplane.Mesh)  # -> NakedEdges, InteriorEdges, NonManifoldEdges
splitatcorners = SplitAtCorners(Poly=crv, Angle=number_slider)  # -> Corners, Parts
pt = Point(splitatcorners.Corners)
join = JoinCurves(Curves=medges.NakedEdges, Preserve=False)
splitatcorners_2 = SplitAtCorners(Poly=join, Angle=1)  # -> Corners, Parts
pt_2 = Point(splitatcorners_2.Corners)
item = ListItem(List=splitatcorners_2.Parts, Index=0, Wrap=True)
pipe = Pipe(Curve=item, Radius=1, Caps=0)
