# Grasshopper definition MeshOutput ShirnkByColor.gh (Grasshopper 1.0.7)
# plug-ins: Kangaroo2 Components

R = Rectangle({Plane=PlaneXY(35, 35, 0), Size=Domain2(u=-35..35, v=-35..35)})
X = XSamples(Slider(80, range=0..100))

division = Division(A=X, B=Slider(2, range=1..5))
mplane = MeshPlane(Boundary=R, WidthCount=division, HeightCount=division)  # -> Mesh, Area

img = ImportImage(
    File="C:\Users\meari\Documents\GitHub\Kangaroo-examples-NEW\NetworkWarping ShrinkByColour\robert_de_niro_new_york_1993.jpg",
    Rectangle=R,
    XSamples=expr("x+1", X),
    YSamples=expr("x+1", X))
mesh = Mesh(img)
medges = MeshEdges(Mesh=mesh)  # -> NakedEdges, InteriorEdges, NonManifoldEdges
relay = Relay([medges.InteriorEdges, medges.NakedEdges])
join = JoinCurves(Curves=medges.NakedEdges, Preserve=False)
splitatcorners = SplitAtCorners(Poly=join, Angle=1)  # -> Corners, Parts
nv = NakedVertices(Mesh=mesh)  # -> ClothedIndex, NakedIndex, ClothedPts, NakedPts
tri = Triangulate(Mesh=mesh)  # -> Mesh, Count
explode = Explode(Curve=splitatcorners.Parts, Recursive=True)  # -> Segments, Vertices

anchor = Anchor(Point=splitatcorners.Corners, Strength=1e+80)
oncurve = OnCurve(Points=explode.Vertices, Curve=graft(splitatcorners.Parts), Strength=10)
shrinkbycolour_goal = ShrinkByColour(
    L=relay,
    M=tri.Mesh,
    invert=0,
    strength=Slider(7.015, range=0..8),
    Reference="C:\Program Files\Rhino 7\Plug-ins\Grasshopper\Components\KangarooSolver.dll")  # -> out, A; inputs L: list of Line, M: Mesh, invert: Boolean, strength: Double
# ---------- shrinkbycolour_goal: C# usings ----------
using System.IO;
using System.Linq;
using System.Data;
using System.Drawing;
using System.Reflection;
using System.Windows.Forms;
using System.Xml;
using System.Xml.Linq;
using System.Runtime.InteropServices;

using Rhino.DocObjects;
using Rhino.Collections;
using GH_IO;
using GH_IO.Serialization;
using KPlankton;
using KangarooSolver;
using KangarooSolver.Goals;
# ---------- shrinkbycolour_goal: C# ----------
    var goals = new ShrinkByColour[L.Count];

    for(int i = 0;i < L.Count;i++) goals[i] = new ShrinkByColour(L[i].From, L[i].To, M, strength, invert);
    A = goals;
# ---------- shrinkbycolour_goal: C# additional code ----------
  public class ShrinkByColour : GoalObject
  {
    Mesh M;
    double L;
    bool invert;
    public ShrinkByColour(Point3d s, Point3d e, Mesh M, double k, bool invert)
    {
      PPos = new Point3d[2] { s, e }; //initial positions
      Move = new Vector3d[2];
      this.M = M;
      L = s.DistanceTo(e);
      Weighting = new double[2]{k / L,k / L};
      this.invert = invert;
    }

    public override void Calculate(List<KangarooSolver.Particle> p)
    {
      var positions = this.GetCurrentPositions(p);
      var startPt = positions[0];
      var endPt = positions[1];
      Point3d midPt = 0.5 * (startPt + endPt);
      Color c = M.ColorAt(M.ClosestMeshPoint(midPt, 0));
      double colorval = invert ? 1.0 - (c.R / 255.0) : c.R / 255.0;

      Move[0] = (midPt - startPt) * (1.0 - 0.8 * colorval);
      Move[1] = -Move[0];
    }

    public override object Output(List<KangarooSolver.Particle> p)
    {
      return new Line(p[PIndex[0]].Position, p[PIndex[1]].Position);
    }
  }
# ---------- end shrinkbycolour_goal ----------
smooth = Smooth(M=mesh, Strength=1)
anchor_2 = Anchor(Point=[nv.ClothedPts, nv.NakedPts], Strength=Slider(0.029, range=0..1))
onplane = OnPlane(Points=[nv.ClothedPts, nv.NakedPts], Plane=PlaneXY(0, 0, 0), Strength=1)
onmesh = OnMesh(Points=nv.ClothedPts, Mesh=mesh, Strength=100)
show = Show(G=mplane.Mesh)

entwine = Entwine(Branch00=show, Branch01=[anchor, onmesh, oncurve, smooth, anchor_2, onplane, shrinkbycolour_goal.A], FlattenInputs=True)
zombiesolver = ZombieSolver(Threshold=1e-10, Tolerance=0.0001, MaxIterations=50000)  # -> I, V, O
solver = Solver(GoalObjects=entwine, Reset=Button(), Threshold=1e-15, Tolerance=0.01, On=Toggle(False))  # -> I, V, O
bang = ExplodeTree(Data=solver.O)  # -> Branch0, Branch1
mesh_2 = Mesh(bang.Branch0)
