# Grasshopper definition OnOpenMesh StickyMesh Kiss.gh (Grasshopper 1.0.7)
# plug-ins: Kangaroo2 Components

mplane = MeshPlane(Boundary={Plane=PlaneXY(0, 0, 0), Size=Domain2(u=-10..10, v=-10..10)}, WidthCount=10, HeightCount=10)  # -> Mesh, Area
tri = Triangulate(Mesh=mplane.Mesh)  # -> Mesh, Count
move = Move(Geometry=tri.Mesh, Motion=Vector(0, 0, 10))  # -> Geometry, Transform
demesh = DeconstructMesh(Mesh=move.Geometry)  # -> Vertices, Faces, Colours, Normals
mc = MeshCorners(Mesh=[move.Geometry, tri.Mesh], Angle=2.35619449)

anchor = Anchor(Point=mc, Strength=10000)
stickymeshkiss_goal = StickyMeshKissGoal(
    M=tri.Mesh,
    Pts=demesh.Vertices,
    Range=Slider(2.329, range=0..3),
    Strength=Slider(10, range=0..10),
    Reference="C:\Program Files\Rhino 7\Plug-ins\Grasshopper\Components\KangarooSolver.dll")  # -> out, A; inputs M: Mesh, Pts: list of Point3d, Range: Double, Strength: Double
# ---------- stickymeshkiss_goal: C# usings ----------
using System.IO;
using System.Linq;
using System.Data;
using System.Drawing;
using System.Reflection;
using System.Windows.Forms;
using System.Xml;
using System.Xml.Linq;
using System.Runtime.InteropServices;

using Rhino.DocObjects;
using Rhino.Collections;
using GH_IO;
using GH_IO.Serialization;
using KPlankton;
using KangarooSolver;
using KangarooSolver.Goals;
# ---------- stickymeshkiss_goal: C# ----------
    A = new SnapToMesh (M, Pts.ToArray(), Range, Strength);
# ---------- stickymeshkiss_goal: C# additional code ----------
  //
  public class SnapToMesh : GoalObject
  {
    Mesh M;
    double Range;
    double Strength;

    public SnapToMesh(Mesh M, Point3d[] Pts, double Range, double Strength)
    {
      var mPoints = M.Vertices.ToPoint3dArray();

      var size = Pts.Length + mPoints.Length;
      PPos = new Point3d[size];

      Move = new Vector3d[size];
      Weighting = new double[size];

      for (int i = 0; i < mPoints.Length; i++)
      {
        PPos[i] = mPoints[i];
        Weighting[i] = 0;
      }

      for (int i = mPoints.Length; i < PPos.Length; i++)
      {
        PPos[i] = Pts[i - mPoints.Length];
        Weighting[i] = 0;
      }
      this.M = M;
      this.Range = Range;
      this.Strength = Strength;
    }

    public override void Calculate(List<KangarooSolver.Particle> p)
    {
      for (int i = 0; i < PIndex.Length; i++)
      {
        Move[i] = Vector3d.Zero;
        Weighting[i] = 0;
      }

      for (int i = 0; i < M.Vertices.Count; i++)
      {
        M.Vertices.SetVertex(i, p[PIndex[i]].Position);
        Move[i] = Vector3d.Zero;
      }

      for (int i = M.Vertices.Count; i < PIndex.Length; i++)
      {
        Point3d ThisPt = p[PIndex[i]].Position;
        MeshPoint MP = M.ClosestMeshPoint(ThisPt, Range);

        if (M.IsPointInside(ThisPt, 0, false))
        {
          MeshPoint MP2 = M.ClosestMeshPoint(ThisPt, 0);
          if(MP2 != null)
          {
            var Push = 0.5 * (MP2.Point - ThisPt);
            Move[i] += Push;
        
            Move[M.Faces[MP.FaceIndex].A] -= Push * MP2.T[0];
            Move[M.Faces[MP.FaceIndex].B] -= Push * MP2.T[1];
            Move[M.Faces[MP.FaceIndex].C] -= Push * MP2.T[2];
            
            Weighting[i] =
              Weighting[M.Faces[MP.FaceIndex].A] =
              Weighting[M.Faces[MP.FaceIndex].B] =
              Weighting[M.Faces[MP.FaceIndex].C] = Strength;
          }
         
        }
        
        else if(MP != null)
        {
          var Pull = 0.05 * (ThisPt - MP.Point);
          Move[i] -= Pull;

          Move[M.Faces[MP.FaceIndex].A] += Pull * MP.T[0];
          Move[M.Faces[MP.FaceIndex].B] += Pull * MP.T[1];
          Move[M.Faces[MP.FaceIndex].C] += Pull * MP.T[2];

          Weighting[i] =
            Weighting[M.Faces[MP.FaceIndex].A] =
            Weighting[M.Faces[MP.FaceIndex].B] =
            Weighting[M.Faces[MP.FaceIndex].C] = Strength;
        }





      }

    }
  }
# ---------- end stickymeshkiss_goal ----------
edgelengths = EdgeLengths(Mesh=[move.Geometry, tri.Mesh], LengthFactor=Slider(0.83, range=0..1), Strength=1)
grab = Grab(On=True, Strength=1, Range=3)
show = Show(G=[tri.Mesh, move.Geometry])

entwine = Entwine(Branch00=show, Branch01=[edgelengths, anchor, grab, stickymeshkiss_goal.A], FlattenInputs=True)
solver = Solver(GoalObjects=entwine, Reset=Button(), Threshold=1e-15, Tolerance=0.01, On=True)  # -> I, V, O
bang = ExplodeTree(Data=solver.O)  # -> Branch0, Branch1
colourful = Colourful(geo=bang.Branch0)

# ==== cluster Colourful: Display objects in bright colours
geo = ClusterInput()
geo_2 = Geometry(geo)
clean = CleanTree(RemoveNulls=True, RemoveInvalid=True, RemoveEmpty=False, Tree=flatten(geo_2))
S = Shader([{diffuse=RGB(11, 125, 222), emission=RGB(3, 38, 67), shine=0.5, specular=RGB(255, 255, 255), transparency=0}, {diffuse=RGB(222, 37, 11), emission=RGB(67, 11, 3), shine=0.5, specular=RGB(255, 255, 255), transparency=0}, {diffuse=RGB(71, 222, 11), emission=RGB(21, 67, 3), shine=0.5, specular=RGB(255, 255, 255), transparency=0}, {diffuse=RGB(222, 194, 11), emission=RGB(67, 58, 3), shine=0.5, specular=RGB(255, 255, 255), transparency=0}])
lng = ListLength(List=clean)
repeat = RepeatData(Data=S, Length=lng)
preview = CustomPreview(Geometry=clean, Shader=repeat)
