# Grasshopper definition StickyKisses StickyMesh Kiss.gh (Grasshopper 1.0.7)
# plug-ins: Kangaroo2 Components

mesh = Mesh(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)
mesh_2 = Mesh(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)

demesh = DeconstructMesh(Mesh=mesh_2)  # -> Vertices, Faces, Colours, Normals
relay = Relay([mesh_2, mesh])

stickymeshkiss_goal = StickyMeshKissGoal(
    M=mesh,
    Pts=demesh.Vertices,
    Range=Slider(3.68, range=0..10),
    Strength=Slider(0.179, range=0..10),
    Reference="C:\Program Files\Rhino 7\Plug-ins\Grasshopper\Components\KangarooSolver.dll")  # -> out, A; inputs M: Mesh, Pts: list of Point3d, Range: Double, Strength: Double
# ---------- stickymeshkiss_goal: C# usings ----------
using System.IO;
using System.Linq;
using System.Data;
using System.Drawing;
using System.Reflection;
using System.Windows.Forms;
using System.Xml;
using System.Xml.Linq;
using System.Runtime.InteropServices;

using Rhino.DocObjects;
using Rhino.Collections;
using GH_IO;
using GH_IO.Serialization;
using KPlankton;
using KangarooSolver;
using KangarooSolver.Goals;
# ---------- stickymeshkiss_goal: C# ----------
    A = new SnapToMesh (M, Pts.ToArray(), Range, Strength);
# ---------- stickymeshkiss_goal: C# additional code ----------
  //
  public class SnapToMesh : GoalObject
  {
    Mesh M;
    double Range;
    double Strength;

    public SnapToMesh(Mesh M, Point3d[] Pts, double Range, double Strength)
    {
      var mPoints = M.Vertices.ToPoint3dArray();

      var size = Pts.Length + mPoints.Length;
      PPos = new Point3d[size];

      Move = new Vector3d[size];
      Weighting = new double[size];

      for (int i = 0; i < mPoints.Length; i++)
      {
        PPos[i] = mPoints[i];
        Weighting[i] = 0;
      }

      for (int i = mPoints.Length; i < PPos.Length; i++)
      {
        PPos[i] = Pts[i - mPoints.Length];
        Weighting[i] = 0;
      }
      this.M = M;
      this.Range = Range;
      this.Strength = Strength;
    }

    public override void Calculate(List<KangarooSolver.Particle> p)
    {
      for (int i = 0; i < PIndex.Length; i++)
      {
        Move[i] = Vector3d.Zero;
        Weighting[i] = 0;
      }

      for (int i = 0; i < M.Vertices.Count; i++)
      {
        M.Vertices.SetVertex(i, p[PIndex[i]].Position);
        Move[i] = Vector3d.Zero;
      }

      for (int i = M.Vertices.Count; i < PIndex.Length; i++)
      {
        Point3d ThisPt = p[PIndex[i]].Position;
        MeshPoint MP = M.ClosestMeshPoint(ThisPt, Range);

        if (M.IsPointInside(ThisPt, 0, false))
        {
          MeshPoint MP2 = M.ClosestMeshPoint(ThisPt, 0);
          if(MP2 != null)
          {
            var Push = 0.5 * (MP2.Point - ThisPt);
            Move[i] += Push;
        
            Move[M.Faces[MP.FaceIndex].A] -= Push * MP2.T[0];
            Move[M.Faces[MP.FaceIndex].B] -= Push * MP2.T[1];
            Move[M.Faces[MP.FaceIndex].C] -= Push * MP2.T[2];
            
            Weighting[i] =
              Weighting[M.Faces[MP.FaceIndex].A] =
              Weighting[M.Faces[MP.FaceIndex].B] =
              Weighting[M.Faces[MP.FaceIndex].C] = Strength;
          }
         
        }
        
        else if(MP != null)
        {
          var Pull = 0.05 * (ThisPt - MP.Point);
          Move[i] -= Pull;

          Move[M.Faces[MP.FaceIndex].A] += Pull * MP.T[0];
          Move[M.Faces[MP.FaceIndex].B] += Pull * MP.T[1];
          Move[M.Faces[MP.FaceIndex].C] += Pull * MP.T[2];

          Weighting[i] =
            Weighting[M.Faces[MP.FaceIndex].A] =
            Weighting[M.Faces[MP.FaceIndex].B] =
            Weighting[M.Faces[MP.FaceIndex].C] = Strength;
        }





      }

    }
  }
# ---------- end stickymeshkiss_goal ----------
volume = Volume(Mesh=mesh, Strength=1)
volume_2 = Volume(Mesh=relay, Strength=1)
show = Show(G=relay)
edgelengths = EdgeLengths(Mesh=relay, LengthFactor=0.9, Strength=1)
grab = Grab(On=True, Strength=100, Range=5)

entwine = Entwine(Branch00=show, Branch01=[edgelengths, grab, volume, volume_2, stickymeshkiss_goal.A], FlattenInputs=True)
solver = Solver(GoalObjects=entwine, Reset=Button(), Threshold=1e-15, Tolerance=0.01, On=Toggle(False))  # -> I, V, O
bang = ExplodeTree(Data=solver.O)  # -> Branch0, Branch1
item = ListItem(List=bang.Branch0, Index=0, Wrap=True)  # -> Item, Item1
mesh_3 = Mesh(item.Item)
mesh_4 = Mesh(item.Item1)
