# Grasshopper definition Bending Angle Lenght(Line).gh (Grasshopper 1.0.7)
# plug-ins: Kangaroo2 Components

crv = Curve(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)
# First we break the curve into many
# short straight segments.
divide = DivideCurve(Curve=crv, Count=25, Kinks=False)  # -> Points, Tangents, Parameters
pline = PolyLine(Vertices=divide.Points, Closed=False)
explode = Explode(Curve=pline, Recursive=True)  # -> Segments, Vertices
# See also the 'Rod' example for a simpler
# way of achieving this.
shift = ShiftList(List=explode.Segments, Shift=1, Wrap=False)
short = ShortestList(ListA=explode.Segments, ListB=shift, TrimMode=2)  # -> ListA, ListB

length_line = LengthLine(Line=explode.Segments, Strength=10)
angle = Angle(LineA=short.ListA, LineB=short.ListB, RestAngle="0", Strength=1)

solver = Solver(GoalObjects=[length_line, angle], Reset=Button(), Threshold=1e-15, Tolerance=0.01, On=True)  # -> I, V, O
