# Grasshopper definition Rod Rod.gh (Grasshopper 1.0.7)
# plug-ins: Kangaroo2 Components

crv = Curve(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)
divide = DivideCurve(Curve=crv, Count=25, Kinks=False)  # -> Points, Tangents, Parameters
pline = PolyLine(Vertices=divide.Points, Closed=False)
rod = Rod(Polyline=pline, LengthFactor=1, AngleFactor="0", AxialStrength=10, BendStrength=1)
grab = Grab(On=True, Strength=1, Range=3)  # -> Grab, Anchors
reset = Button()
solver = Solver(GoalObjects=[rod, grab.Grab], Reset=reset, Threshold=1e-15, Tolerance=0.01, On=True)  # -> I, V, O
data = Data(solver.O)
