# Grasshopper definition Catenary Anchor Length(Line).gh (Grasshopper 1.0.7)
# plug-ins: Kangaroo2 Components

mplane = MeshPlane(Boundary={Plane=PlaneXY(0, 0, 0), Size=Domain2(u=-10..10, v=-10..10)}, WidthCount=10, HeightCount=10)  # -> Mesh, Area

# ---- group: stretch resistance for edges
# See also the file Catenary2 for a simpler
# way of doing this.
medges = MeshEdges(Mesh=mplane.Mesh)  # -> NakedEdges, InteriorEdges, NonManifoldEdges
length_line = LengthLine(Line=[medges.NakedEdges, medges.InteriorEdges], Strength=10)

# ---- group: apply loads to all vertices
demesh = DeconstructMesh(Mesh=mplane.Mesh)  # -> Vertices, Faces, Colours, Normals
load = Load(Point=demesh.Vertices, ForceVector=Vector(0, 0, 1))

# ---- group: fix corners in place
mc = MeshCorners(Mesh=mplane.Mesh, Angle=2.35619449)
anchor = Anchor(Point=mc, Strength=1000)

# ----
grab = Grab(On=True, Strength=1, Range=3)  # -> Grab, Anchors

reset = Button()
solver = Solver(GoalObjects=[anchor, length_line, load, grab.Grab], Reset=reset, Threshold=1e-15, Tolerance=0.01, On=True)  # -> I, V, O
data = Data(solver.O)
