# Grasshopper definition Catenary2 VertextLoads Anchor EdgeLength.gh (Grasshopper 1.0.7)
# plug-ins: Kangaroo2 Components

mplane = MeshPlane(Boundary={Plane=PlaneXY(0, 0, 0), Size=Domain2(u=-10..10, v=-10..10)}, WidthCount=10, HeightCount=10)  # -> Mesh, Area
mc = MeshCorners(Mesh=mplane.Mesh, Angle=2.35619449)

edgelengths = EdgeLengths(Mesh=mplane.Mesh, LengthFactor=1, Strength=10)
anchor = Anchor(Point=mc, Strength=1000)
vertexloads = VertexLoads(Mesh=mplane.Mesh, Strength=Slider(1, range=0.5..10))
grab = Grab(On=True, Strength=1, Range=3)  # -> Grab, Anchors

reset = Button()
solver = Solver(GoalObjects=[anchor, grab.Grab, edgelengths, vertexloads], Reset=reset, Threshold=1e-15, Tolerance=0.01, On=True)  # -> I, V, O
data = Data(solver.O)
