# Grasshopper definition CirclePackOnSurface SphereCollide OnMesh.gh (Grasshopper 1.0.7)
# plug-ins: Kangaroo2 Components

srf = Surface(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)
number_slider = Slider(0.868, range=0..2)
popgeo = PopulateGeometry(Geometry=srf, Count=Slider(338, range=1..1000), Seed=1)
show = Show(G=popgeo)
onmesh = OnMesh(Points=popgeo, Mesh=srf, Strength=1)
sc = SphereCollide(Points=popgeo, Radius=number_slider, Strength=1)
solver = Solver(GoalObjects=[onmesh, sc, show], Reset=Button(), Threshold=1e-15, Tolerance=0.01, On=True)  # -> I, V, O
srf_cp = SurfaceClosestPoint(Point=solver.O, Surface=srf)  # -> Point, UVPoint, Distance
evalsrf = EvaluateSurface(Surface=srf, Point=srf_cp.UVPoint)  # -> Point, Normal, UDirection, VDirection, Frame
cir = Circle(Plane=evalsrf.Frame, Radius=number_slider)
