# Grasshopper definition CirclePackOnSurface_pull SphereCollide OnMesh Length(Line).gh (Grasshopper 1.0.7)
# plug-ins: Kangaroo2 Components

srf = Surface(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)
number_slider = Slider(0.265, range=0..2)
pt = Point(Point(12, 0, 11))
popgeo = PopulateGeometry(Geometry=srf, Count=Slider(153, range=1..1000), Seed=Slider(127, range=1..1000))
X = UnitX(Factor=-0.01)
ln = Line(StartPoint=popgeo, EndPoint=pt)

grab = Grab(On=True, Strength=1, Range=3)  # -> Grab, Anchors
load = Load(Point=popgeo, ForceVector=X)
show = Show(G=popgeo)
onmesh = OnMesh(Points=popgeo, Mesh=srf, Strength=1)
sc = SphereCollide(Points=popgeo, Radius=number_slider, Strength=Slider(12, range=0..100))
length_line = LengthLine(Line=ln, Length=0, Strength=0.001)
anchor = Anchor(Point=pt, Strength=10000)

solver = Solver(
    GoalObjects=[onmesh, sc, show, grab.Grab, length_line, anchor],
    Reset=Button(),
    Threshold=1e-15,
    Tolerance=0.01,
    On=Toggle(True))  # -> I, V, O
srf_cp = SurfaceClosestPoint(Point=solver.V, Surface=srf)  # -> Point, UVPoint, Distance
evalsrf = EvaluateSurface(Surface=srf, Point=srf_cp.UVPoint)  # -> Point, Normal, UDirection, VDirection, Frame
cir = Circle(Plane=evalsrf.Frame, Radius=number_slider)
