# Grasshopper definition CirclePacking SphereCurveCollide OnMesh Collider.gh (Grasshopper 1.0.7)
# plug-ins: Kangaroo2 Components

# ---- group: Range for radii
number_slider = Slider(1.6, range=0..10)
number_slider_2 = Slider(3.074, range=0..10)

# ---- group: Number of circles
# This example shows circle packing on a dome, with circles of random radii, keeping them tangent to the boundary.
# It uses a custom goal - you will need to set the assembly reference location to wherever you have KangarooSolver.dll installed - typically C:\Users\YourName\AppData\Roaming\Grasshopper\Libraries
number_slider_3 = Slider(345, range=10..1000)

# ----
dom = ConstructDomain(DomainStart=number_slider, DomainEnd=number_slider_2)
brep = Brep(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)
N = Count(number_slider_3)

# ---- group: Multiplier (adjust to fill surface)
number_slider_4 = Slider(0.291, range=0..1)

# ----
edges = BrepEdges(Brep=brep)  # -> Naked, Interior, NonManifold
random = Random(Range=dom, Number=N, Seed=2)
popgeo = PopulateGeometry(Geometry=brep, Count=N, Seed=3)
multiplication = Multiplication(A=random, B=number_slider_4)
crv = Curve(edges.Naked)
spherecurvecollide = SphereCurveCollide(
    C=crv,
    Pts=popgeo,
    Radii=multiplication,
    Strength="1",
    Reference="C:\Program Files\Rhino 7\Plug-ins\Grasshopper\Components\KangarooSolver.dll")  # -> out, A; inputs C: Curve, Pts: list of Point3d, Radii: list of Double, Strength: Double
# ---------- spherecurvecollide: C# ----------
    A = new SphereCurveCollide(C, Pts, Radii, Strength);
# ---------- spherecurvecollide: C# additional code ----------
  public class SphereCurveCollide : GoalObject
  {
    Curve C;
    double strength;
    double[] radii;

    public SphereCurveCollide(Curve Crv, List<Point3d> Pts, List<double> Radii, double k)
    {
      C = Crv;
      int L = Pts.Count;
      PPos = Pts.ToArray();
      Move = new Vector3d[L];
      Weighting = new double[L];
      radii = Radii.ToArray();
      strength = k;
    }

    public override void Calculate(List<KangarooSolver.Particle> p)
    {
      for (int i = 0; i < PIndex.Length; i++)
      {
        Point3d Pt = p[PIndex[i]].Position;
        double t;
        if(C.ClosestPoint(Pt, out t, radii[i]))
        {
          Point3d Closest = C.PointAt(t);
          Vector3d Push = Pt - Closest;
          Push.Unitize();
          Push *= radii[i];
          Point3d Target = Closest + Push;
          Move[i] = Target - Pt;
          Weighting[i] = strength;
        }
        else
        {
          Move[i] = Vector3d.Zero;
          Weighting[i] = 0;
        }
      }
    }
  }
# ---------- end spherecurvecollide ----------

grab = Grab(On=True, Strength=1, Range=3)  # -> Grab, Anchors
onmesh = OnMesh(Points=popgeo, Mesh=brep, Strength="1")
collider = Collider(Objects=popgeo, Radii=multiplication, Strength=1)

reset = Button()
solver = Solver(
    GoalObjects=[collider, onmesh, grab.Grab, spherecurvecollide.A],
    Reset=reset,
    Threshold=1e-15,
    Tolerance=0.01,
    On=Toggle(True))  # -> I, V, O
evaluate_surface = EvaluateSurface(surface=brep, point=solver.V)  # -> p_at_uv, normal, U, V, F, closest_point, distance_to_edge
cir = Circle(Plane=evaluate_surface.F, Radius=multiplication)

# ==== cluster EvaluateSurface
point = ClusterInput()
surface = ClusterInput()
srf_cp = SurfaceClosestPoint(Point=point, Surface=surface)  # -> Point, UVPoint, Distance
edges = BrepEdges(Brep=surface)  # -> Naked, Interior, NonManifold
join = JoinCurves(Curves=edges.Naked, Preserve=False)
evalsrf = EvaluateSurface(Surface=surface, Point=srf_cp.UVPoint)  # -> PAtUV, Normal, UDirection, VDirection, Frame
pull = PullPoint(Point=point, Geometry=join, ClosestOnly=True)  # -> ClosestPoint, simplify(DistanceToEdge)
normal = ClusterOutput(evalsrf.Normal)
V = ClusterOutput(evalsrf.VDirection)
F = ClusterOutput(evalsrf.Frame)
p_at_uv = ClusterOutput(evalsrf.PAtUV)
U = ClusterOutput(evalsrf.UDirection)
closest_point = ClusterOutput(pull.ClosestPoint)
distance_to_edge = ClusterOutput(pull.DistanceToEdge)
