# Grasshopper definition Collide2d_shapes Collide2D Polygon Area Angle.gh (Grasshopper 1.0.7)
# plug-ins: Kangaroo2 Components

cir = Circle(Plane=PlaneXY(11, 8, 0), Radius=3)
C = Curve([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])
divide = DivideCurve(Curve=cir, Count=18, Kinks=False)  # -> Points, Tangents, Parameters
pline = PolyLine(Vertices=divide.Points, Closed=True)
crv = Curve(flatten([pline, C]))
area = Area(Geometry=pline)  # -> Area, Centroid
explode = Explode(Curve=C, Recursive=True)  # -> Segments, Vertices
explode_2 = Explode(Curve=crv, Recursive=True)  # -> Segments, Vertices
shift = ShiftList(List=explode.Segments, Shift=1, Wrap=True)
multiplication = Multiplication(A=Slider(0.817, range=0..1), B=area.Area)
end = EndPoints(Curve=explode_2.Segments)  # -> Start, End

grab = Grab(On=True, Strength=1, Range=3)  # -> Grab, Anchors
polygonarea = PolygonArea(Polyline=pline, Area=multiplication, Strength=1)
c2d = Collide2d(Polylines=crv, Plane=PlaneXY(0, 0, 0), Strength=1)
onplane = OnPlane(Points=end.End, Plane=PlaneXY(0, 0, 0), Strength=1)  # -> flatten(P)
length_line = LengthLine(Line=explode_2.Segments, Strength=10)  # -> flatten(Spring)
angle = Angle(LineA=explode.Segments, LineB=shift, Strength=1)  # -> flatten(Angle)

solver = Solver(
    GoalObjects=[angle, length_line, c2d, grab.Grab, polygonarea, onplane],
    Reset=Button(),
    Threshold=1e-15,
    Tolerance=0.01,
    On=True)  # -> I, V, O
