# Grasshopper definition Curly Kale V1 wrinkly_update Sphere Colide Angle Length(Line).gh (Grasshopper 1.0.7)
# plug-ins: Kangaroo2 Components, Weaverbird

R = Radius(12)
# https://discourse.mcneel.com/t/differential-growth-script-curly-kale-issue-opening-script/109883/2?u=quan_li
custom_mesh_settings = SettingsCustom(
    StitchSeams=True,
    SimplePlanes=False,
    Refine=True,
    MinCount=16,
    MaxCount=400,
    AspectRatio=20,
    MaxDistance=0,
    MaxAngle=20,
    MinEdge=0,
    MaxEdge=1)
cir = Circle(Plane=PlaneXY(0, 0, 0), Radius=R)
mesh = MeshBrep(Brep=cir, Settings=custom_mesh_settings)
mesh_2 = Mesh(cir)
demesh = DeconstructMesh(Mesh=mesh)  # -> Vertices, Faces, Colours, Normals
vlen = VectorLength(Vector=demesh.Vertices)
remap = RemapNumbers(Value=vlen, Source=R, Target=Domain(0, 1))  # -> Mapped, Clipped
subtraction = Subtraction(A=1, B=remap.Mapped)
hsl = ColourHSL(Alpha=1, Hue=0, Saturation=1, Luminance=subtraction)
conmesh = ConstructMesh(Vertices=demesh.Vertices, Faces=demesh.Faces, Colours=hsl)
remeshbycolour = RemeshByColour(
    Mesh=conmesh,
    LengthInterval=Domain(0.3, 2),
    FixCurves=cir,
    Flip=1,
    Iterations=Slider(20, range=0..100),
    Reset=[True, False])
item = ListItem(List=reverse(remeshbycolour), Index=0, Wrap=True)
dam = DataDam(DataA=item, BufferDelay=10000000, BufferMode=0)
medges = MeshEdges(Mesh=dam)  # -> NakedEdges, InteriorEdges, NonManifoldEdges
join = JoinCurves(Curves=medges.NakedEdges, Preserve=False)
relay = Relay([medges.InteriorEdges, medges.NakedEdges])
demesh_2 = DeconstructMesh(Mesh=dam)  # -> Vertices, Faces, Colours, Normals
explode = Explode(Curve=join, Recursive=True)  # -> Segments, Vertices
shift = ShiftList(List=explode.Segments, Shift=1, Wrap=True)

smooth = Smooth(M=dam, Strength=25)
grab = Grab(On=True, Strength=1, Range=3)
show = Show(G=dam)
sc = SphereCollide(Points=demesh_2.Vertices, Radius=3, Strength=1)
length_line = LengthLine(Line=relay, Strength=0.2)
angle = Angle(LineA=explode.Segments, LineB=shift, RestAngle=0, Strength=10)

entwine = Entwine(Branch00=show, Branch01=[length_line, sc, smooth, angle, grab], FlattenInputs=True)
solver = Solver(GoalObjects=entwine, Reset=Button(), Threshold=1e-15, Tolerance=0.01, On=Toggle(True))  # -> I, V, flatten(O)
bang = ExplodeTree(Data=solver.O)  # -> Branch0, Branch1
item_2 = ListItem(List=solver.O, Index=0, Wrap=True)
wbloop = WeaverbirdsLoopSubdivision(MeshCurves=bang.Branch0, Level=2, SmoothNakedEdges=1)
