# Grasshopper definition Image_circlepacking ImageCircles.gh (Grasshopper 1.0.7)
# plug-ins: Kangaroo2 Components

# ---- group: gradually increase this until circles are packed
number_slider = Slider(0.912, range=0..2)

# ----
N = Count(1700)
pop2d = Populate2D(Region={Plane=PlaneXY(3.176457033, 1.369751357, 0), Size=Domain2(u=0..13.69824552, v=0..7.527864653)}, Count=N, Seed=1)
multiplication = Multiplication(A=Slider(0.02, range=0..1), B=number_slider)
multiplication_2 = Multiplication(A=Slider(0.33, range=0..1), B=number_slider)
mesh = Mesh(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)
crv = Curve(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)
imgcircles = ImageCircles(Points=pop2d, Mesh=mesh, Min=multiplication, Max=multiplication_2, Curves=crv, Strength=1)
solver = Solver(GoalObjects=imgcircles, Reset=Button(), Threshold=1e-15, Tolerance=0.01, On=Toggle(True))  # -> I, V, O
cir = Circle(Plane=solver.V, Radius=solver.O)
