# Grasshopper definition balloondemo SolidPointColide.gh (Grasshopper 1.0.7)
# plug-ins: Weaverbird, Kangaroo2 Components

pt = Point([Point(4, 1.838160609, 8), Point(-4, 0, 10), Point(4, -2.318583528, 15)])
wbicosahedron = WeaverbirdsMeshMeshIcosahedron(Plane=pt, Radius=4)
wbloop = WeaverbirdsLoopSubdivision(MeshCurves=wbicosahedron, Level=1, SmoothNakedEdges=1)  # -> flatten(OutputMeshCurves)
crossref = CrossReference(ListA=wbloop, ListB=wbloop, CrossMode=5)  # -> ListA, ListB
demesh = DeconstructMesh(Mesh=wbloop)  # -> flatten(Vertices), Faces, Colours, Normals
mesh = Mesh(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)
medges = MeshEdges(Mesh=wbloop)  # -> NakedEdges, InteriorEdges, NonManifoldEdges
demesh_2 = DeconstructMesh(Mesh=crossref.ListB)  # -> Vertices, Faces, Colours, Normals
strength = Strength(100)
Z = UnitZ(Factor=-0.5)

grab = Grab(On=True, Strength=10000, Range=3)  # -> Grab, Anchors
load = Load(Point=demesh.Vertices, ForceVector=Z)
floor = Floor(Strength=100)
length_line = LengthLine(Line=[medges.NakedEdges, medges.InteriorEdges], Strength=15)
pressure = Pressure(M=wbloop, Strength=3)
spc = SolidPointCollide(Points=demesh_2.Vertices, Solid=crossref.ListA, Interior=False, Unidirectional=False, Strength=strength)
spc_2 = SolidPointCollide(Points=demesh.Vertices, Solid=mesh, Interior=False, Unidirectional=Toggle(True), Strength=strength)
show = Show(G=[wbloop, mesh])

entwine = Entwine(Branch00=show, Branch01=[length_line, pressure, floor, load, spc, spc_2], FlattenInputs=True)
solver_bouncy = SolverBouncy(
    GoalObjects=[entwine, grab.Grab],
    Reset=Button(),
    Threshold=1e-15,
    Tolerance=0.01,
    Damping=0.996,
    Iterations=12,
    On=Toggle(False))  # -> I, V, O
split = SplitList(List=solver_bouncy.O, Index=3)  # -> ListA, ListB
wbloop_2 = WeaverbirdsLoopSubdivision(MeshCurves=split.ListA, Level=2, SmoothNakedEdges=1)
colourful = Colourful(geo=flatten(wbloop_2))

# ==== cluster Colourful: Display objects in bright colours
geo = ClusterInput()
geo_2 = Geometry(geo)
clean = CleanTree(RemoveNulls=True, RemoveInvalid=True, RemoveEmpty=False, Tree=flatten(geo_2))
lng = ListLength(List=clean)
S = Shader([{diffuse=RGB(11, 125, 222), emission=RGB(3, 38, 67), shine=0.5, specular=RGB(255, 255, 255), transparency=0}, {diffuse=RGB(222, 37, 11), emission=RGB(67, 11, 3), shine=0.5, specular=RGB(255, 255, 255), transparency=0}, {diffuse=RGB(71, 222, 11), emission=RGB(21, 67, 3), shine=0.5, specular=RGB(255, 255, 255), transparency=0}, {diffuse=RGB(222, 194, 11), emission=RGB(67, 58, 3), shine=0.5, specular=RGB(255, 255, 255), transparency=0}])
repeat = RepeatData(Data=S, Length=lng)
preview = CustomPreview(Geometry=clean, Shader=repeat)
