# Grasshopper definition cableCollide Collider Length(Line).gh (Grasshopper 1.0.7)
# plug-ins: Kangaroo2 Components

crv = Curve([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])
divide = DivideCurve(Curve=crv, Count=10, Kinks=False)  # -> Points, Tangents, Parameters
shatter = Shatter(Curve=graft(crv), Parameters=divide.Parameters)  # -> flatten(Segments)
line = Line(shatter)

collider = Collider(Objects=line, Radii=0.2, Strength=1)
length_line = LengthLine(Line=line, Strength=10)
grab = Grab(On=True, Strength=1, Range=3)  # -> Grab, Anchors

solver = Solver(GoalObjects=[collider, grab.Grab, length_line], Reset=Button(), Threshold=1e-15, Tolerance=0.01, On=True)  # -> I, V, O
