# Grasshopper definition chain_collider Collider RigidPointSet.gh (Grasshopper 1.0.7)
# plug-ins: Kangaroo2 Components, Mesh Pipe

crv = Curve([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])
divide = DivideCurve(Curve=crv, Count=10, Kinks=False)  # -> Points, Tangents, Parameters
pline = PolyLine(Vertices=divide.Points, Closed=True)
data = Data(divide.Points)
explode = Explode(Curve=pline, Recursive=True)  # -> Segments, Vertices
line = Line(explode.Segments)

grab = Grab(On=True, Strength=1, Range=3)
show = Show(G=pline)
collider = Collider(Objects=flatten(line), Radii="2", Strength=10)
rigidpointset = RigidPointSet(Points=data, Strength=10)  # -> RigidBody, Planes

entwine = Entwine(Branch00=show, Branch01=[collider, grab, rigidpointset.RigidBody], FlattenInputs=True)
solver = Solver(GoalObjects=entwine, Reset=Button(), Threshold=1e-15, Tolerance=0.01, On=True)  # -> I, V, O
bang = ExplodeTree(Data=solver.O)  # -> Branch0, Branch1
explode_2 = Explode(Curve=bang.Branch0, Recursive=True)  # -> Segments, Vertices
end = EndPoints(Curve=explode_2.Segments)  # -> Start, End
intcrv = Interpolate(Vertices=end.Start, Degree=3, Periodic=True, KnotStyle=1)  # -> Curve, Length, Domain
mpipe = MeshPipe(Curve=intcrv.Curve, Radius="2", Accuracy=0.2, Rotation=0, Segments=10, Caps=0)
rebuildnormals = CSharpScript(x=mpipe)  # -> out, A; inputs x: Mesh
# ---------- rebuildnormals: C# ----------
    x.RebuildNormals();
    A = x;
# ---------- end rebuildnormals ----------
preview = CustomPreview(
    Geometry=rebuildnormals.A,
    Material={diffuse=RGB(255, 215, 0), emission=RGB(0, 0, 0), shine=0.9, specular=RGB(255, 255, 255), transparency=0})
