# Grasshopper definition chain_collision Collider RegidPointSet.gh (Grasshopper 1.0.7)
# plug-ins: Kangaroo2 Components, Mesh Pipe, Weaverbird

crv = Curve([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])
explode = Explode(Curve=crv, Recursive=True)  # -> Segments, Vertices
number_slider = Slider(0.988, range=0..10)
end = EndPoints(Curve=explode.Segments)  # -> Start, End
line = Line(explode.Segments)

grab = Grab(On=True, Strength=1, Range=3)  # -> Grab, Anchors
collider = Collider(Objects=flatten(line), Radii=number_slider, Strength=1)
rigidpointset = RigidPointSet(Points=end.Start, Strength=10)  # -> RigidBody, Planes
show = Show(G=crv)

entwine = Entwine(Branch00=[rigidpointset.RigidBody, collider, grab.Grab], Branch01=show, FlattenInputs=True)
solver = Solver(GoalObjects=entwine, Reset=Button(), Threshold=1e-15, Tolerance=0.01, On=Toggle(True))  # -> I, V, O
# To display the output, this definition uses the mesh pipe component from here:
# http://www.grasshopper3d.com/forum/topics/mesh-pipe
# 
# and Weaverbird:
# http://www.grasshopper3d.com/group/weaverbird
bang = ExplodeTree(Data=solver.O)  # -> Branch0, Branch1
mpipe = MeshPipe(Curve=bang.Branch1, Radius=number_slider, Accuracy=0.2, Rotation=0, Segments=6, Caps=0)
c_script = CSharpScript(x=mpipe)  # -> out, A
# ---------- c_script: C# ----------
    Mesh M = x as Mesh;
    M.Normals.ComputeNormals();
    A = M;
# ---------- end c_script ----------
wbcatmullclark = WeaverbirdsCatmullClarkSubdivision(MeshCurves=c_script.A, Level=Slider(1, range=0..10), SmoothNakedEdges=1)
