# Grasshopper definition cloth_inflatable_collision SphereCollide SolidPointClollide Floor Load.gh (Grasshopper 1.0.7)
# plug-ins: Kangaroo2 Components, Weaverbird

# ----
# Cloth
mesh = Mesh(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)

# ----
# Sphere
mesh_2 = Mesh(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)

tri = Triangulate(Mesh=mesh)  # -> Mesh, Count
tri_2 = Triangulate(Mesh=mesh_2)  # -> Mesh, Count
clean = CombineClean(Meshes=tri_2.Mesh)
demesh = DeconstructMesh(Mesh=tri.Mesh)  # -> Vertices, Faces, Colours, Normals
medges = MeshEdges(Mesh=clean)  # -> NakedEdges, InteriorEdges, NonManifoldEdges
medges_2 = MeshEdges(Mesh=tri.Mesh)  # -> NakedEdges, InteriorEdges, NonManifoldEdges
Z = UnitZ(Factor=-0.1)

grab = Grab(On=True, Strength=1, Range=3)  # -> Grab, Anchors
length_line = LengthLine(Line=[medges_2.InteriorEdges, medges_2.NakedEdges], Strength=10)
load = Load(Point=demesh.Vertices, ForceVector=Z)
show = Show(G=tri.Mesh)
show_2 = Show(G=clean)
floor = Floor(Strength=1)

# ---- group: cloth self-collision using spheres
sc = SphereCollide(Points=demesh.Vertices, Radius=Slider(1.7, range=0..5), Strength=1)

# ---- group: 2-way collision between balloon and cloth
spc = SolidPointCollide(Points=demesh.Vertices, Solid=clean, Interior=False, Unidirectional=False, Strength=1)

# ---- group: preserving volume, and decreasing edge lengths for balloon
length_line_2 = LengthLine(Line=medges.InteriorEdges, Length=Slider(0.1, range=0..1), Strength=0.1)
volume = Volume(Mesh=clean, Strength=0.1)

# ----
entwine = Entwine(
    Branch00=[length_line, load, floor, volume, spc, length_line_2, sc, grab.Grab],
    Branch01=show,
    Branch02=show_2,
    FlattenInputs=True)
solver = Solver(GoalObjects=entwine, Reset=Button(), Threshold=1e-15, Tolerance=0.01, On=Toggle(True))  # -> I, V, O
bang = ExplodeTree(Data=solver.O)  # -> Branch0, Branch1, Branch2
wbloop = WeaverbirdsLoopSubdivision(MeshCurves=bang.Branch2, Level=1, SmoothNakedEdges=1)
wbloop_2 = WeaverbirdsLoopSubdivision(MeshCurves=bang.Branch1, Level=1, SmoothNakedEdges=1)
