# Grasshopper definition clothcollide SphereCollide.gh (Grasshopper 1.0.7)
# plug-ins: Kangaroo2 Components, Weaverbird

mplane = MeshPlane(Boundary={Plane=PlaneXY(0, 0, 0), Size=Domain2(u=-10..10, v=-10..10)}, WidthCount=10, HeightCount=10)  # -> Mesh, Area
demesh = DeconstructMesh(Mesh=mplane.Mesh)  # -> Vertices, Faces, Colours, Normals

grab = Grab(On=True, Strength=1, Range=3)  # -> Grab, Anchors
edgelengths = EdgeLengths(Mesh=mplane.Mesh, LengthFactor=1, Strength=1)
show = Show(G=mplane.Mesh)
sc = SphereCollide(Points=demesh.Vertices, Radius=Slider(1.5, range=0..10), Strength=1)

solver = Solver(GoalObjects=[sc, grab.Grab, show, edgelengths], Reset=Button(), Threshold=1e-15, Tolerance=0.01, On=True)  # -> I, V, O
data = Data(solver.O)
# This definition uses the Weaverbird
# plugin to further subdivide the output
# from Kangaroo
wbcatmullclark = WeaverbirdsCatmullClarkSubdivision(MeshCurves=data, Level=3, SmoothNakedEdges=2)
