# Grasshopper definition collide_simple ClampLength.gh (Grasshopper 1.0.7)
# plug-ins: Kangaroo2 Components

addition = Addition(A="3", B="3")
# This file is just to illustrate how sphere collisions are
# essentially the same as clamping the minimum distance
# between the centre points as the sum of the radii.
# 
# 
# However, using this approach for increasing numbers of
# points would soon become very slow, which is why is
# why the SphereCollide component exists.
crv = Curve(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)
clamplength = ClampLength(Line=crv, LowerLimit=addition, UpperLimit=999999999, Strength=1)
grab = Grab(On=True, Strength=1, Range=3)  # -> Grab, Anchors
solver = Solver(GoalObjects=[clamplength, grab.Grab], Reset=Button(), Threshold=1e-15, Tolerance=0.01, On=True)  # -> I, V, O
cir = Circle(Plane=solver.V, Radius="3")
