# Grasshopper definition drape SolidPointCollide.gh (Grasshopper 1.0.7)
# plug-ins: Kangaroo2 Components

number_slider = Slider(30, range=0..100)
mplane = MeshPlane(
    Boundary={Plane=PlaneXY(-15, -10, 7), Size=Domain2(u=0..40, v=0..40)},
    WidthCount=number_slider,
    HeightCount=number_slider)  # -> Mesh, Area
demesh = DeconstructMesh(Mesh=mplane.Mesh)  # -> Vertices, Faces, Colours, Normals
medges = MeshEdges(Mesh=mplane.Mesh)  # -> NakedEdges, InteriorEdges, NonManifoldEdges
Z = UnitZ(Factor=-0.1)
brep = Brep(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)
crv = Curve([medges.NakedEdges, medges.InteriorEdges])

floor = Floor(Strength=1)
length_line = LengthLine(Line=crv, Strength=10)
spc = SolidPointCollide(Points=demesh.Vertices, Solid=brep, Interior=False, Unidirectional="True", Strength=1)
load = Load(Point=demesh.Vertices, ForceVector=Z)

solver = Solver(GoalObjects=[length_line, spc, floor, load], Reset=Button(), Threshold=1e-15, Tolerance=0.01, On=Toggle(False))  # -> I, V, O
data = Data(solver.O)
