# Grasshopper definition floorcollide SphereCollide Floor Load.gh (Grasshopper 1.0.7)
# plug-ins: Kangaroo2 Components

pop3d = Populate3D(
    Region={Plane=Plane(origin=(5, 4, 0), x=(0, 1, 0), y=(1, 0, 0)), X=Domain(0, 17), Y=Domain(0, 18), Z=Domain(-16, 0)},
    Count=500,
    Seed=1)
Z = UnitZ(Factor=-0.1)

grab = Grab(On=True, Strength=1, Range=3)  # -> Grab, Anchors
sc = SphereCollide(Points=pop3d, Radius="1", Strength=1)
floor = Floor(Strength=1)
load = Load(Point=pop3d, ForceVector=Z)

button = Button()
toggle = BooleanToggle(False)
solver = Solver(Reset=button, Threshold=1e-15, Tolerance=0.01, On=toggle)  # -> I, V, O; disabled
bouncysolver = BouncySolver(
    GoalObjects=[grab.Grab, sc, load, floor],
    Reset=button,
    Threshold=1e-15,
    Tolerance=0.01,
    Damping=1,
    Iterations=10,
    On=toggle)  # -> I, V, O
msphere = MeshSphere(Base=bouncysolver.V, Radius="1", UCount=4, VCount=8)
