# Grasshopper definition multiradius_spherecollide Collider.gh (Grasshopper 1.0.7)
# plug-ins: Kangaroo2 Components

pt = Point([Point(12, 10, 0), Point(4, 4, 0), Point(4, 14, 0), Point(24, 14, 0), Point(17, 4, 0)])
lng = ListLength(List=pt)
random = Random(Range="1 to 6", Number=lng, Seed=2)

grab = Grab(On=True, Strength=1, Range=3)  # -> Grab, Anchors
collider = Collider(Objects=pt, Radii=random, Strength=1)

solver = Solver(GoalObjects=[collider, grab.Grab], Reset=Button(), Threshold=1e-15, Tolerance=0.01, On=True)  # -> I, V, O
msphere = MeshSphere(Base=solver.V, Radius=random, UCount=10, VCount=20)
