# Grasshopper definition packing_circles_on_sphere_with_set_of_radii Collider.gh (Grasshopper 1.0.7)
# plug-ins: Kangaroo2 Components

# https://discourse.mcneel.com/t/question-regarding-packing-objects-on-a-sphere-or-hemi-sphere/171240/2
number_slider = Slider(180, range=0..1000)
sph = Sphere(Base=PlaneXY(0, 0, 0), Radius=number_slider)
srf = Surface(sph)
quanity = Slider(335, range=0..1250)
panel = Panel("""5
10
20
30""")
lng = ListLength(List=panel)
subtraction = Subtraction(A=lng, B=1)
popgeo = PopulateGeometry(Geometry=srf, Count=quanity, Seed=Slider(100, range=0..100))
random = Random(Range=subtraction, Number=quanity, Seed=2)
item = ListItem(List=panel, Index=random, Wrap=True)
num = Number(item)

onmesh = OnMesh(Points=popgeo, Mesh=srf, Strength=1)
collider = Collider(Objects=popgeo, Radii=num, Strength=2)
show = Show(G=popgeo)

entwine = Entwine(Branch00=show, Branch01=[onmesh, collider], FlattenInputs=True)
solver = Solver(GoalObjects=entwine, Reset=Button(), Threshold=1e-15, Tolerance=0.0001, On=Toggle(False))  # -> I, V, O
bang = ExplodeTree(Data=solver.O)  # -> Branch0, Branch1
brep_cp = BrepClosestPoint(Point=bang.Branch0, Brep=srf)  # -> Point, Normal, Distance
circle = CircleCNR(Center=brep_cp.Point, Normal=brep_cp.Normal, Radius=num)
darc = DeconstructArc(Arc=circle)  # -> BasePlane, Radius, Angle
cset = CreateSet(List=darc.Radius)  # -> Set, Map
