# Grasshopper definition rigid_body_collision RigidBody RigidBodyCollide.gh (Grasshopper 1.0.7)
# plug-ins: Kangaroo2 Components

brep = Brep([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])
crossref = CrossReference(ListA=brep, ListB=brep, CrossMode=5)  # -> graft(ListA), graft(ListB)
debrep = DeconstructBrep(Brep=brep)  # -> Faces, Edges, Vertices
mesh = Mesh([crossref.ListA, crossref.ListB])
item = ListItem(List=mesh, Index=0, Wrap=True)  # -> Item, Item1
Z = UnitZ(Factor=-0.05)
reset = Button()
run = BooleanToggle(False)

grab = Grab(On=True, Strength=100, Range=3)  # -> Grab, Anchors
solidplanecollide = SolidPlaneCollide(Solid=brep, CollisionPlane=PlaneXY(0, 0, 0), Strength=3)
rigidbody = RigidBody(Part=graft(brep), Points=debrep.Vertices, Strength=3)  # -> RigidBody, Planes
rigidbodycollide = RigidBodyCollide(MeshA=item.Item, MeshB=item.Item1, Strength=1)

pt = Point(flatten(rigidbody.Planes))

load = Load(Point=pt, ForceVector=Z)

solver_bouncy = SolverBouncy(
    GoalObjects=[load, grab.Grab, solidplanecollide, rigidbody.RigidBody, rigidbodycollide],
    Reset=reset,
    Threshold=1e-08,
    Tolerance=0.01,
    Damping=0.98,
    Iterations=15,
    On=run)  # -> I, V, O
clean = CleanTree(RemoveNulls=True, RemoveInvalid=True, RemoveEmpty=False, Tree=solver_bouncy.O)
mesh_2 = Mesh(solver_bouncy.O)
edges = BrepEdges(Brep=solver_bouncy.O)  # -> Naked, Interior, NonManifold
colourful = Colourful(geo=mesh_2)
panel = Panel(clean)

# ==== cluster Colourful: Display objects in bright colours
geo = ClusterInput()
geo_2 = Geometry(geo)
clean = CleanTree(RemoveNulls=True, RemoveInvalid=True, RemoveEmpty=False, Tree=flatten(geo_2))
S = Shader([{diffuse=RGB(11, 125, 222), emission=RGB(3, 38, 67), shine=0.5, specular=RGB(255, 255, 255), transparency=0}, {diffuse=RGB(222, 37, 11), emission=RGB(67, 11, 3), shine=0.5, specular=RGB(255, 255, 255), transparency=0}, {diffuse=RGB(71, 222, 11), emission=RGB(21, 67, 3), shine=0.5, specular=RGB(255, 255, 255), transparency=0}, {diffuse=RGB(222, 194, 11), emission=RGB(67, 58, 3), shine=0.5, specular=RGB(255, 255, 255), transparency=0}])
lng = ListLength(List=clean)
repeat = RepeatData(Data=S, Length=lng)
preview = CustomPreview(Geometry=clean, Shader=repeat)
