# Grasshopper definition solidParticleCollide SolidPointCollide SphereCollide Load.gh (Grasshopper 1.0.7)
# plug-ins: Kangaroo2 Components

R = Region({Plane=PlaneXY(-6, -7, 0.7377762218), X=Domain(0, 23), Y=Domain(0, 30), Z=Domain(0, 37.52444756)})
R_2 = Radius(1)
pop3d = Populate3D(Region=R, Count=400, Seed=1)
brep = Brep(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)
Z = UnitZ(Factor=-0.01)

spc = SolidPointCollide(Points=pop3d, Solid=brep, Interior=False, Unidirectional=Toggle(True), Strength=1)
sc = SphereCollide(Points=pop3d, Radius=R_2, Strength=10)
load = Load(Point=pop3d, ForceVector=Z)

reset = Button()
on = BooleanToggle(False)
solver = Solver(GoalObjects=[sc, load, spc], Reset=reset, Threshold=1e-15, Tolerance=0.01, On=on)  # -> I, V, O
cloud = CloudDisplay(Points=solver.V, Colours=RGB(35, 55, 186), Size=R_2, SpriteType=1)
