# Grasshopper definition squishpack_signature_ring  Rod OnMesh Collider.gh (Grasshopper 1.0.8)
# plug-ins: Kangaroo2 Components

# https://discourse.mcneel.com/t/box-morph-issue-circle-packing/89921/8?u=quan_li
brep = Brep(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)
popgeo = PopulateGeometry(Geometry=brep, Count=60, Seed=1)
brep_cp = BrepClosestPoint(Point=popgeo, Brep=brep)  # -> Point, Normal, Distance
pl = PlaneNormal(Origin=brep_cp.Point, ZAxis=brep_cp.Normal)
cir = Circle(Plane=pl, Radius=1)
divide = DivideCurve(Curve=cir, Count=20, Kinks=False)  # -> Points, Tangents, Parameters
number_slider = Slider(1.503, range=1..2)
pline = PolyLine(Vertices=divide.Points, Closed=True)
explode = Explode(Curve=pline, Recursive=True)  # -> flatten(Segments), Vertices
line = Line(explode.Segments)
item = ListItem(List=line, Index=0, Wrap=True)
len = Length(Curve=item)
multiplication = Multiplication(A=number_slider, B=len)
multiplication_2 = Multiplication(A=multiplication, B=Slider(0.798, range=0..1))

show = Show(G=pline)
rod = Rod(Polyline=pline, LengthFactor=number_slider, AngleFactor=0, AxialStrength=1, BendStrength=1)
onmesh = OnMesh(Points=divide.Points, Mesh=brep, Strength=100)
collider = Collider(Objects=line, Radii=multiplication_2, Strength=10)

entwine = Entwine(Branch00=show, Branch01=[rod, onmesh, collider], FlattenInputs=True)
solver = Solver(GoalObjects=entwine, Reset=Button(), Threshold=1e-15, Tolerance=0.01, On=Toggle(False))  # -> I, V, O
bang = ExplodeTree(Data=solver.O)  # -> Branch0, Branch1
crv = Curve(bang.Branch0)
dam = DataDam(DataA=crv, BufferDelay=10000000, BufferMode=0)
explode_2 = Explode(Curve=dam, Recursive=True)  # -> Segments, Vertices
avr = Average(Input=explode_2.Vertices)
intcrv = Interpolate(Vertices=explode_2.Vertices, Degree=3, Periodic=True, KnotStyle=1)  # -> Curve, Length, Domain
brep_cp_2 = BrepClosestPoint(Point=avr, Brep=brep)  # -> Point, Normal, Distance
pl_2 = PlaneNormal(Origin=brep_cp_2.Point, ZAxis=brep_cp_2.Normal)
neg = Negative(Value=Slider(0.332, range=0..1))
offset = OffsetCurve(Curve=graft(intcrv.Curve), Distance=Slider(0.26, range=0..1), Plane=pl_2, Corners=0)
offset_2 = OffsetCurve(Curve=graft(intcrv.Curve), Distance=neg, Plane=pl_2, Corners=0)
project = Project(Geometry=offset_2, Plane=pl_2)  # -> Geometry, Transform
project_2 = Project(Geometry=offset, Plane=pl_2)  # -> Geometry, Transform
boundary = BoundarySurfaces(Edges=[project_2.Geometry, project.Geometry])
extr = Extrude(Base=boundary, Direction=brep_cp_2.Normal)
