# Grasshopper definition squishycurves Collider Polygon Area Rod.gh (Grasshopper 1.0.7)
# plug-ins: Kangaroo2 Components

rectangle = Rectangle(Plane=PlaneXY(0, 0, 0), XSize=Slider(79, range=0..100), YSize=Slider(100, range=0..100), Radius=0)  # -> Rectangle, Length
number_slider = Slider(8.754, range=0..10)
crv = Curve(rectangle.Rectangle)
offset = OffsetCurve(Curve=rectangle.Rectangle, Distance=expr("-x", number_slider), Plane=PlaneXY(0, 0, 0), Corners=1)
pop2d = Populate2D(Region=offset, Count=Slider(10, range=0..10), Seed=4)
cir = Circle(Plane=pop2d, Radius=number_slider)
divide = DivideCurve(Curve=cir, Count=Slider(20, range=0..100), Kinks=False)  # -> Points, Tangents, Parameters
pline = PolyLine(Vertices=divide.Points, Closed=True)  # -> flatten(Polyline)
explode = Explode(Curve=pline, Recursive=True)  # -> flatten(Segments), Vertices
end = EndPoints(Curve=explode.Segments)  # -> Start, End
area = Area(Geometry=pline)  # -> Area, Centroid
line = Line(explode.Segments)
data = Data(divide.Points)
mesh = Mesh(crv)
multiplication = Multiplication(A=area.Area, B=Slider(1, range=0..1))
Y = UnitY(Factor=-0.04)

onplane = OnPlane(Points=end.End, Plane=PlaneXY(0, 0, 0), Strength=1)  # -> flatten(P)
show = Show(G=pline)
polygonarea = PolygonArea(Polyline=pline, Area=multiplication, Strength=0.1)
rod = Rod(Polyline=pline, LengthFactor=1, AngleFactor=0, AxialStrength=1, BendStrength=1)
collider = Collider(Objects=line, Radii=Slider(0.492, range=0..1), Strength=5)
onmesh = OnMesh(Points=data, Mesh=mesh, Strength=1)  # -> flatten(P)
load = Load(Point=data, ForceVector=Y, Weighting=1)
grab = Grab(On=True, Strength=1, Range=3)

entwine = Entwine(Branch00=show, Branch01=[grab, polygonarea, onplane, onmesh, load, rod, collider], FlattenInputs=True)
solver = Solver(GoalObjects=entwine, Reset=Button(), Threshold=1e-15, Tolerance=0.01, On=Toggle(False))  # -> I, V, O
bang = ExplodeTree(Data=solver.O)  # -> Branch0, Branch1
crv_2 = Curve(bang.Branch0)
mesh_2 = Mesh(bang.Branch0)
colourful = Colourful(geo=mesh_2)

# ==== cluster Colourful: Display objects in bright colours
geo = ClusterInput()
geo_2 = Geometry(geo)
clean = CleanTree(RemoveNulls=True, RemoveInvalid=True, RemoveEmpty=False, Tree=flatten(geo_2))
S = Shader([{diffuse=RGB(11, 125, 222), emission=RGB(3, 38, 67), shine=0.5, specular=RGB(255, 255, 255), transparency=0}, {diffuse=RGB(222, 37, 11), emission=RGB(67, 11, 3), shine=0.5, specular=RGB(255, 255, 255), transparency=0}, {diffuse=RGB(71, 222, 11), emission=RGB(21, 67, 3), shine=0.5, specular=RGB(255, 255, 255), transparency=0}, {diffuse=RGB(222, 194, 11), emission=RGB(67, 58, 3), shine=0.5, specular=RGB(255, 255, 255), transparency=0}])
lng = ListLength(List=clean)
repeat = RepeatData(Data=S, Length=lng)
preview = CustomPreview(Geometry=clean, Shader=repeat)
