# Grasshopper definition FoldThroughPrevention NoFoldThrough Planarize.gh (Grasshopper 1.0.7)
# plug-ins: Kangaroo2 Components

mesh = Mesh(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)

# ---- group: prevent foldthrough
tri = Triangulate(Mesh=mesh)  # -> Mesh, Count
hingepoints = HingePoints(Mesh=tri.Mesh)  # -> _1, _2, _3, _4
nofoldthrough = NoFoldThrough(FoldStart=hingepoints._1, FoldEnd=hingepoints._2, Tip1=hingepoints._3, Tip2=hingepoints._4, Strength=1)

# ---- group: maintain edge lengths
edgelengths = EdgeLengths(Mesh=tri.Mesh, LengthFactor=1, Strength=1)

# ----
grab = Grab(On=True, Strength=1, Range=3)  # -> Grab, Anchors
show = Show(G=mesh)

# ---- group: keep the quads planar
planarize = Planarize(M=mesh, Strength=1)

# ----
reset = Button()
entwine = Entwine(Branch00=[nofoldthrough, planarize, edgelengths, grab.Grab], Branch01=show, FlattenInputs=True)
solver = Solver(GoalObjects=entwine, Reset=reset, Threshold=1e-15, Tolerance=0.01, On=True)  # -> I, V, O
bang = ExplodeTree(Data=solver.O)  # -> Branch0, Branch1
mesh_2 = Mesh(bang.Branch1)
