# Grasshopper definition Origami Hinge PlasticAnchor.gh (Grasshopper 1.0.7)
# plug-ins: Kangaroo2 Components

folding = Slider(0, range=0..0.99)

# ---- group: mesh of flat folding pattern
# To start, Press the 'Reset' button below  then slowly change the 'Folding' slider.
# You can replace the mesh with a different
# pattern, and choose edges from it to assign
# to mountain or valley folds.
mesh = Mesh(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)

# ---- group: Valley fold lines
crv = Curve([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])

# ---- group: Mountain fold lines
crv_2 = Curve([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])

# ----
angle = Panel("-pi")
angle_2 = Panel("pi")
multiplication = Multiplication(A=angle, B=folding)
multiplication_2 = Multiplication(A=angle_2, B=folding)
hingepoints = HingePoints(Mesh=mesh)  # -> _1, _2, _3, _4
ln = Line(StartPoint=hingepoints._1, EndPoint=hingepoints._2)
eval = EvaluateCurve(Curve=reparameterize(crv), Parameter=0.5)  # -> Point, Tangent, Angle
eval_2 = EvaluateCurve(Curve=reparameterize(crv_2), Parameter=0.5)  # -> Point, Tangent, Angle
eval_3 = EvaluateCurve(Curve=ln, Parameter=0.5)  # -> graft(Point), Tangent, Angle
dist = Distance(PointA=eval.Point, PointB=eval_3.Point)
dist_2 = Distance(PointA=eval_2.Point, PointB=eval_3.Point)
sort = SortList(Keys=dist)  # -> Keys, ValuesA
demesh = DeconstructMesh(Mesh=mesh)  # -> Vertices, Faces, Colours, Normals
sort_2 = SortList(Keys=dist_2)  # -> Keys, ValuesA
medges = MeshEdges(Mesh=mesh)  # -> NakedEdges, InteriorEdges, NonManifoldEdges
item = ListItem(List=sort.Keys, Index=0, Wrap=True)
item_2 = ListItem(List=sort_2.Keys, Index=0, Wrap=True)

show = Show(G=mesh)
plasticanchor = PlasticAnchor(Point=demesh.Vertices, Limit=0.01, Strength=0.001)
length_line = LengthLine(Line=[medges.NakedEdges, medges.InteriorEdges], Strength=1)
hinge = Hinge(
    FoldStart=hingepoints._1,
    FoldEnd=hingepoints._2,
    Tip1=hingepoints._3,
    Tip2=hingepoints._4,
    RestAngle=multiplication,
    Strength=0.1)
hinge_2 = Hinge(
    FoldStart=hingepoints._1,
    FoldEnd=hingepoints._2,
    Tip1=hingepoints._3,
    Tip2=hingepoints._4,
    RestAngle=multiplication_2,
    Strength=0.1)

smaller = SmallerThan(FirstNumber=item, SecondNumber=0.01)  # -> flatten(SmallerThan), OrEqualTo
smaller_2 = SmallerThan(FirstNumber=item_2, SecondNumber=0.01)  # -> flatten(SmallerThan), OrEqualTo
cull = CullPattern(List=hinge, CullPattern=smaller.SmallerThan)
cull_2 = CullPattern(List=hinge_2, CullPattern=smaller_2.SmallerThan)
reset = Button()
solver = Solver(
    GoalObjects=[length_line, cull, cull_2, show, plasticanchor],
    Reset=reset,
    Threshold=1e-15,
    Tolerance=0.01,
    On=Toggle(True))  # -> I, V, O
