# Grasshopper definition Origami2 Hinge PlasticAnchor.gh (Grasshopper 1.0.7)
# plug-ins: Kangaroo2 Components

# ---- group: mesh of flat folding pattern
# This version should also work with meshes that include quads.
mesh = Mesh(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)

# ----
folding = Slider(0.377, range=0..0.99)
tri = Triangulate(Mesh=mesh)  # -> Mesh, Count
angle = Panel("pi")
angle_2 = Panel("-pi")
hingepoints = HingePoints(Mesh=tri.Mesh)  # -> _1, _2, _3, _4
multiplication = Multiplication(A=angle, B=folding)
multiplication_2 = Multiplication(A=angle_2, B=folding)

# ---- group: Mountain fold lines
crv = Curve([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])

# ----
ln = Line(StartPoint=hingepoints._1, EndPoint=hingepoints._2)

# ---- group: Valley fold lines
crv_2 = Curve(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)

# ----
eval = EvaluateCurve(Curve=reparameterize(crv_2), Parameter=0.5)  # -> Point, Tangent, Angle
eval_2 = EvaluateCurve(Curve=reparameterize(crv), Parameter=0.5)  # -> Point, Tangent, Angle
eval_3 = EvaluateCurve(Curve=ln, Parameter=0.5)  # -> graft(Point), Tangent, Angle
dist = Distance(PointA=eval.Point, PointB=eval_3.Point)
dist_2 = Distance(PointA=eval_2.Point, PointB=eval_3.Point)

# ---- group: maintain edge lengths
medges = MeshEdges(Mesh=tri.Mesh)  # -> NakedEdges, InteriorEdges, NonManifoldEdges
length_line = LengthLine(Line=[medges.NakedEdges, medges.InteriorEdges], Strength=10)

# ---- group: a weak plastic anchor on all points prevents drift
demesh = DeconstructMesh(Mesh=tri.Mesh)  # -> Vertices, Faces, Colours, Normals
plasticanchor = PlasticAnchor(Point=demesh.Vertices, Limit=0.01, Strength=0.01)

# ----
sort = SortList(Keys=dist)  # -> Keys, ValuesA
sort_2 = SortList(Keys=dist_2)  # -> Keys, ValuesA

planarize = Planarize(M=mesh, Strength=0.001)
show = Show(G=mesh)
hinge = Hinge(
    FoldStart=hingepoints._1,
    FoldEnd=hingepoints._2,
    Tip1=hingepoints._3,
    Tip2=hingepoints._4,
    RestAngle=multiplication_2,
    Strength=0.01)
hinge_2 = Hinge(
    FoldStart=hingepoints._1,
    FoldEnd=hingepoints._2,
    Tip1=hingepoints._3,
    Tip2=hingepoints._4,
    RestAngle=multiplication,
    Strength=0.01)

item = ListItem(List=sort.Keys, Index=0, Wrap=True)
item_2 = ListItem(List=sort_2.Keys, Index=0, Wrap=True)
smaller = SmallerThan(FirstNumber=item, SecondNumber=0.01)  # -> flatten(SmallerThan), OrEqualTo
smaller_2 = SmallerThan(FirstNumber=item_2, SecondNumber=0.01)  # -> flatten(SmallerThan), OrEqualTo
cull = CullPattern(List=hinge, CullPattern=smaller.SmallerThan)
cull_2 = CullPattern(List=hinge_2, CullPattern=smaller_2.SmallerThan)
solver = Solver(
    GoalObjects=[length_line, cull, cull_2, show, plasticanchor, planarize],
    Reset=Button(),
    Threshold=1e-15,
    Tolerance=0.01,
    On=Toggle(True))  # -> I, V, O
