# Grasshopper definition origamitube OnPlane Collider Length.gh (Grasshopper 1.0.8)
# plug-ins: Weaverbird, Kangaroo2 Components

height = Slider(4.052, range=0..5)
twist = Slider(0.478, range=0..0.5)
N = Step(8)
series = Series(Start=0, Step=height, Count=N)
# https://discourse.mcneel.com/t/trying-to-build-an-evolving-folding-surface/111378/3?u=quan_li
# This specific pattern is an interesting one because it cannot actually fold rigidly. It only works in the real world because the facets bend and stretch slightly.
# 
# So don’t feel bad about not getting the lengths consistent when modelling it geometrically in Rhino because it is impossible! The real behaviour of these triangulated cylinders is rather complex - this one even has an interesting pop-through behaviour where it snaps between different less stretched states
# https://www.pnas.org/content/115/9/2032 46
# I’ll put together a grasshopper file to show how this can be modelled.
polygon = Polygon(Plane=PlaneXY(0, 0, 0), Radius=3, Segments=5, FilletRadius=0)  # -> Polygon, Length
series_2 = Series(Start=0, Step=twist, Count=N)
Z = UnitZ(Factor=series)
move = Move(Geometry=polygon.Polygon, Motion=Z)  # -> Geometry, Transform
rotate = Rotate(Geometry=move.Geometry, Angle=series_2, Plane=PlaneXY(0, 0, 0))  # -> Geometry, Transform
shift = ShiftList(List=rotate.Geometry, Shift=1, Wrap=False)
short = ShortestList(ListA=rotate.Geometry, ListB=shift, TrimMode=2)  # -> ListA, ListB
disc = Discontinuity(Curve=short.ListA, Level=1)  # -> Points, Parameters
disc_2 = Discontinuity(Curve=short.ListB, Level=1)  # -> Points, Parameters
shift_2 = ShiftList(List=disc_2.Points, Shift=1, Wrap=True)
item = ListItem(List=rotate.Geometry, Index=0, Wrap=True)  # -> Item1, Item
explode = Explode(Curve=rotate.Geometry, Recursive=True)  # -> Segments, Vertices
ln = Line(StartPoint=shift_2, EndPoint=disc.Points)
ln_2 = Line(StartPoint=disc_2.Points, EndPoint=disc.Points)
squash = Slider(1, range=0..1)
crv = Curve(flatten([explode.Segments, ln, ln_2]))
disc_3 = Discontinuity(Curve=item.Item1, Level=1)  # -> Points, Parameters
plfit = PlaneFit(Points=disc_3.Points)  # -> Plane, Deviation
disc_4 = Discontinuity(Curve=item.Item, Level=1)  # -> Points, Parameters
wbweave = WeaverbirdsMeshFromLinesWeaveBack(Lines=crv, MaximumValence=4)
scale_nu = ScaleNU(Geometry=plfit.Plane, Plane=PlaneXY(0, 0, 0), ScaleX=1, ScaleY=1, ScaleZ=squash)  # -> Geometry, Transform
unweld = UnweldMesh(Mesh=wbweave, Angle=0)
line = Line(crv)

onplane = OnPlane(Points=disc_3.Points, Plane=scale_nu.Geometry, Strength=1)
onplane_2 = OnPlane(Points=disc_4.Points, Plane=PlaneXY(0, 0, 0), Strength=1)
length_line = LengthLine(Line=crv, Strength=10)
collider = Collider(Objects=line, Radii=0.5, Strength=1)
show = Show(G=unweld)

entwine = Entwine(Branch00=show, Branch01=[length_line, onplane, onplane_2, collider], FlattenInputs=True)
reset = Button()
on = BooleanToggle(True)
solver = Solver(GoalObjects=entwine, Reset=reset, Threshold=1e-15, Tolerance=0.01, On=on)  # -> I, V, O
bang = ExplodeTree(Data=solver.O)  # -> Branch0, Branch1
wbtriangles = WeaverbirdsSplitTrianglesSubdivision(MeshCurves=bang.Branch0, Level=6)
wbloop = WeaverbirdsLoopSubdivision(MeshCurves=wbtriangles, Level=1, SmoothNakedEdges=0)
preview = CustomPreview(
    Geometry=wbloop,
    Material={diffuse=RGB(0, 192, 0), emission=RGB(0, 0, 0), shine=0.5, specular=RGB(255, 255, 255), transparency=0})
