# Grasshopper definition CyclicQuad OnPlane.gh (Grasshopper 1.0.7)
# plug-ins: Kangaroo2 Components

mesh = Mesh(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)
demesh = DeconstructMesh(Mesh=mesh)  # -> Vertices, Faces, Colours, Normals

show = Show(G=mesh)
grab = Grab(On=True, Strength=1, Range=3)  # -> Grab, Anchors
cyclicquad = CyclicQuad(M=mesh, Strength=1)
onplane = OnPlane(Points=demesh.Vertices, Plane=PlaneXY(0, 0, 0), Strength=1)

solver = Solver(GoalObjects=[grab.Grab, show, onplane, cyclicquad], Reset=Button(), Threshold=1e-15, Tolerance=0.01, On=True)  # -> I, V, flatten(O)
item = ListItem(List=solver.O, Index=0, Wrap=True)
mesh_2 = Mesh(item)
tri = Triangulate(Mesh=mesh_2)  # -> Mesh, Count
facec = FaceCircles(Mesh=tri.Mesh)  # -> Centers, Ratio
