# Grasshopper definition Grid_straighten Angle Smooth.gh (Grasshopper 1.0.7)
# plug-ins: Kangaroo2 Components

mesh = Mesh(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)
warpweft = WarpWeft(Mesh=mesh)  # -> Warp, Weft, NakedA, NakedB
join = JoinCurves(Curves=warpweft.Weft, Preserve=False)
join_2 = JoinCurves(Curves=warpweft.Warp, Preserve=False)
explode = Explode(Curve=join, Recursive=True)  # -> Segments, Vertices
explode_2 = Explode(Curve=join_2, Recursive=True)  # -> Segments, Vertices
medges = MeshEdges(Mesh=mesh)  # -> NakedEdges, InteriorEdges, NonManifoldEdges
shift = ShiftList(List=explode.Segments, Shift=1, Wrap=False)
shift_2 = ShiftList(List=explode_2.Segments, Shift=1, Wrap=False)
demesh = DeconstructMesh(Mesh=mesh)  # -> Vertices, Faces, Colours, Normals
mc = MeshCorners(Mesh=mesh, Angle=2.35619449)
short = ShortestList(ListA=explode.Segments, ListB=shift, TrimMode=2)  # -> ListA, ListB
short_2 = ShortestList(ListA=explode_2.Segments, ListB=shift_2, TrimMode=2)  # -> ListA, ListB
relay = Relay([medges.NakedEdges, medges.InteriorEdges])

angle = Angle(LineA=short_2.ListA, LineB=short_2.ListB, Strength=1)
angle_2 = Angle(LineA=short.ListA, LineB=short.ListB, Strength=0.1)
grab = Grab(On=True, Strength=1, Range=3)  # -> Grab, Anchors
length_line = LengthLine(Line=relay, Strength=1)
show = Show(G=mesh)
smooth = Smooth(M=mesh, Strength=1)
anchor = Anchor(Point=mc, Strength=10000)
onplane = OnPlane(Points=demesh.Vertices, Plane=PlaneXY(0, 0, 0), Strength=1)

solver = Solver(
    GoalObjects=[angle, angle_2, show, grab.Grab, onplane, length_line, smooth, anchor],
    Reset=Button(),
    Threshold=1e-15,
    Tolerance=0.01,
    On=Toggle(True))  # -> I, V, O
data = Data(solver.O)
