# Grasshopper definition british_museum OnCurve OnMesh.gh (Grasshopper 1.0.7)
# plug-ins: Kangaroo2 Components

mesh = Mesh(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)
medges = MeshEdges(Mesh=mesh)  # -> NakedEdges, InteriorEdges, NonManifoldEdges
relay = Relay([medges.NakedEdges, medges.InteriorEdges])
join = JoinCurves(Curves=medges.NakedEdges, Preserve=False)
len = Length(Curve=join)
sort = SortList(Keys=len, ValuesA=join)  # -> Keys, ValuesA
item = ListItem(List=sort.ValuesA, Index=0, Wrap=True)  # -> Item, Item1
mesh_2 = Mesh(mesh)
explode = Explode(Curve=item.Item1, Recursive=True)  # -> Segments, Vertices
explode_2 = Explode(Curve=item.Item, Recursive=True)  # -> Segments, Vertices
demesh = DeconstructMesh(Mesh=mesh_2)  # -> Vertices, Faces, Colours, Normals
end = EndPoints(Curve=explode_2.Segments)  # -> Start, End
mc = MeshCorners(Mesh=mesh_2, Angle=2.35619449)
end_2 = EndPoints(Curve=explode.Segments)  # -> Start, End
crv = Curve(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)
strength = Strength(1000)
crv_2 = Curve(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)
mesh_3 = Mesh(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)

show = Show(G=mesh)
oncurve = OnCurve(Points=end.Start, Curve=crv, Strength=strength)
oncurve_2 = OnCurve(Points=end_2.Start, Curve=crv_2, Strength=strength)
length_line = LengthLine(Line=relay, Length=0, Strength=0.1)
onmesh = OnMesh(Points=demesh.Vertices, Mesh=mesh_3, Strength=1)
anchor = Anchor(Point=mc, Strength=10000)

solver = Solver(
    GoalObjects=[show, oncurve_2, oncurve, anchor, length_line, onmesh],
    Reset=Button(),
    Threshold=1e-15,
    Tolerance=0.01,
    On=Toggle(False))  # -> I, V, flatten(O)
item_2 = ListItem(List=solver.O, Index=0, Wrap=True)
