# Grasshopper definition cells_indual TangentInCircles RemeshByColor.gh (Grasshopper 1.0.8)
# plug-ins: Kangaroo2 Components

B = Boundary({Plane=PlaneXY(18, 5, 0), Size=Domain2(u=-18..18, v=-5..5)})
# https://discourse.mcneel.com/t/minimum-length-inside-the-voronoi/110516/3?u=quan_li
mplane = MeshPlane(Boundary=B, WidthCount=70, HeightCount=20)  # -> Mesh, Area
demesh = DeconstructMesh(Mesh=mplane.Mesh)  # -> Vertices, Faces, Colours, Normals
devec = DeconstructVector(Vector=demesh.Vertices)  # -> XComponent, YComponent, ZComponent
hsl = ColourHSL(Alpha=1, Hue=0, Saturation=1, Luminance=expr("(1+sin(x))*0.5", devec.XComponent))
explode = Explode(Curve=B, Recursive=True)  # -> Segments, Vertices
conmesh = ConstructMesh(Vertices=demesh.Vertices, Faces=demesh.Faces, Colours=hsl)
remeshbycolour = RemeshByColour(
    Mesh=conmesh,
    LengthInterval=Domain(0.3, 1),
    FixCurves=B,
    FixVertices=explode.Vertices,
    Flip=1,
    Iterations=30,
    Reset=Toggle(False))
item = ListItem(List=remeshbycolour, Index=1, Wrap=True)
nv = NakedVertices(Mesh=item)  # -> ClothedIndex, NakedIndex, ClothedPts, NakedPts
disc = Discontinuity(Curve=B, Level=1)  # -> Points, Parameters
data = Data(nv.NakedPts)

show = Show(G=item)
anchor = Anchor(Point=disc.Points, Strength=10000)
oncurve = OnCurve(Points=data, Curve=B, Strength=100)
tangentincircles = TangentIncircles(Mesh=item, Strength=1)

entwine = Entwine(Branch00=show, Branch01=[tangentincircles, oncurve, anchor], FlattenInputs=True)
solver = Solver(GoalObjects=entwine, Reset=Button(), Threshold=1e-15, Tolerance=0.01, On=True)  # -> I, V, O
tree_branch = TreeBranch(T=solver.O, i=0)  # -> _1, _0
item_2 = ListItem(List=flatten(tree_branch._1), Index=0, Wrap=True)
tc = TangentCircles(Mesh=item_2)  # -> Incircles, CirclePacking, Dual
crv = Curve(tc.Dual)

# ==== cluster TreeBranch: Select tree branches using index of the path True branches are WHITE Others are Black Created By Quan Li
i = ClusterInput()  # Branch Index
T = ClusterInput()  # Tree
data = Data(T)
branch_index = Integer(i)
tstat = TreeStatistics(Tree=data)  # -> Paths, Length, Count
cull_i = CullIndex(List=tstat.Paths, Indices=branch_index, Wrap=True)
item = ListItem(List=tstat.Paths, Index=branch_index, Wrap=True)
branch = TreeBranch(Tree=data, Path=item, MaintainPaths=True)
branch_2 = TreeBranch(Tree=data, Path=cull_i, MaintainPaths=True)
preview = CustomPreview(Geometry=branch, Material=ColourSwatch(SwatchColor=RGB(255, 255, 255)))
_1 = ClusterOutput(branch)  # The branches correspondent to the input branch index
_0 = ClusterOutput(branch_2)  # The branches NOT correspondent to the input branch index
preview_2 = CustomPreview(Geometry=branch_2, Material=ColourSwatch(SwatchColor=RGB(66, 66, 66)))
