# Grasshopper definition dotdistribute EqualLength Rod OnCurve VertexNeighbours.gh (Grasshopper 1.0.8)
# plug-ins: Kangaroo2 Components

mesh = Mesh(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)
mesh_2 = Mesh(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)
mesh_3 = Mesh(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)
# https://discourse.mcneel.com/t/perfect-grid-with-nice-boundary/86390/15?u=quan_li
mesh_4 = Mesh(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)
mesh_5 = Mesh(mesh_4)
nv = NakedVertices(Mesh=mesh_5)  # -> ClothedIndex, NakedIndex, ClothedPts, NakedPts
vn = VertexNeighbours(Mesh=mesh_5, VertexNumber=nv.NakedIndex)  # -> Vertex, Neighbours, Normal
lng = ListLength(List=vn.Neighbours)
warpweft = WarpWeft(Mesh=mesh_5)  # -> Warp, Weft, NakedA, NakedB
smaller = SmallerThan(FirstNumber=lng, SecondNumber="4")  # -> SmallerThan, OrEqualTo
join = JoinCurves(Curves=warpweft.Weft, Preserve=False)
join_2 = JoinCurves(Curves=warpweft.Warp, Preserve=False)
cull = CullPattern(List=vn.Vertex, CullPattern=flatten(smaller.SmallerThan))
relay = Relay([join_2, join])
crv = Curve(relay)
del = DelaunayMesh(Points=cull, Plane=PlaneXY(0, 0, 0))
del_2 = DelaunayMesh(Points=nv.NakedPts, Plane=PlaneXY(0, 0, 0))
explode = Explode(Curve=crv, Recursive=True)  # -> Segments, Vertices
medges = MeshEdges(Mesh=del)  # -> NakedEdges, InteriorEdges, NonManifoldEdges
shift = ShiftList(List=explode.Segments, Shift=1, Wrap=False)
crv_2 = Curve(medges.NakedEdges)
short = ShortestList(ListA=explode.Segments, ListB=shift, TrimMode=2)  # -> graft(ListA), graft(ListB)
crv_3 = Curve(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)
data = Data(flatten(explode.Segments))
data_2 = Data([short.ListA, short.ListB])

oncurve = OnCurve(Points=cull, Curve=crv_3, Strength=1000)
length_line = LengthLine(Line=crv_2, Length=0, Strength=Slider(3, range=0..31))
equallength = EqualLength(Line=crv_2, Strength=1)
rod = Rod(Polyline=relay, LengthFactor=1, AngleFactor=1, AxialStrength=1, BendStrength=25)
equallength_2 = EqualLength(Line=data_2, Strength=500)

tree_branch = TreeBranch(T=data_2, i=Slider(10, range=0..10))  # -> _1, _0
solver = Solver(
    GoalObjects=[oncurve, length_line, equallength, rod, equallength_2],
    Reset=Button(),
    Threshold=1e-15,
    Tolerance=0.01,
    On=True)  # -> I, V, O
dot = DotDisplay(Point=solver.V)
pt = Point(solver.V)

# ==== cluster TreeBranch: Select tree branches using index of the path True branches are WHITE Others are Black Created By Quan Li
i = ClusterInput()  # Branch Index
T = ClusterInput()  # Tree
data = Data(T)
branch_index = Integer(i)
tstat = TreeStatistics(Tree=data)  # -> Paths, Length, Count
cull_i = CullIndex(List=tstat.Paths, Indices=branch_index, Wrap=True)
item = ListItem(List=tstat.Paths, Index=branch_index, Wrap=True)
branch = TreeBranch(Tree=data, Path=item, MaintainPaths=True)
branch_2 = TreeBranch(Tree=data, Path=cull_i, MaintainPaths=True)
preview = CustomPreview(Geometry=branch, Material=ColourSwatch(SwatchColor=RGB(255, 255, 255)))
_1 = ClusterOutput(branch)  # The branches correspondent to the input branch index
_0 = ClusterOutput(branch_2)  # The branches NOT correspondent to the input branch index
preview_2 = CustomPreview(Geometry=branch_2, Material=ColourSwatch(SwatchColor=RGB(66, 66, 66)))
