# Grasshopper definition equalize EqualLength.gh (Grasshopper 1.0.7)
# plug-ins: Kangaroo2 Components

mesh = Mesh(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)
tri = Triangulate(Mesh=mesh)  # -> Mesh, Count
demesh = DeconstructMesh(Mesh=mesh)  # -> Vertices, Faces, Colours, Normals
medges = MeshEdges(Mesh=tri.Mesh)  # -> NakedEdges, InteriorEdges, NonManifoldEdges
faceb = FaceBoundaries(Mesh=tri.Mesh)
explode = Explode(Curve=faceb, Recursive=True)  # -> Segments, Vertices
P = Point([Point(5, 0, 5), Point(5, 0, 15)])
crv = Curve([medges.NakedEdges, medges.InteriorEdges])
xz = XZPlane(Origin=Point(0, 0, 0))

grab = Grab(On=True, Strength=1, Range=3)  # -> Grab, Anchors
show = Show(G=crv)
equallength = EqualLength(Line=explode.Segments, Strength=1)
onplane = OnPlane(Points=demesh.Vertices, Plane=xz, Strength=1)
anchor = Anchor(Point=P, Strength=1000)

solver = Solver(
    GoalObjects=[grab.Grab, show, equallength, onplane, anchor],
    Reset=Button(),
    Threshold=1e-15,
    Tolerance=0.01,
    On=Toggle(True))  # -> I, V, O
data = Data(solver.O)
