# Grasshopper definition gridrelax01 OnCurve(quadmesh).gh (Grasshopper 1.0.7)
# plug-ins: Kangaroo2 Components

mesh = Mesh(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)
refine = Refine(Mesh=mesh, Level=Slider(2, range=1..3))
clean = CombineClean(Meshes=refine)
medges = MeshEdges(Mesh=clean)  # -> NakedEdges, InteriorEdges, NonManifoldEdges
relay = Relay([medges.NakedEdges, medges.InteriorEdges])
join = JoinCurves(Curves=medges.NakedEdges, Preserve=False)
item = ListItem(List=join, Index=0, Wrap=True)  # -> Item, Item1
explode = Explode(Curve=item.Item, Recursive=True)  # -> Segments, Vertices
end = EndPoints(Curve=explode.Segments)  # -> Start, End
strength = Strength(1000)
crv = Curve(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)

oncurve = OnCurve(Points=end.Start, Curve=crv, Strength=strength)
show = Show(G=clean)
length_line = LengthLine(Line=relay, Length=0, Strength=0.01)

solver = Solver(GoalObjects=[show, oncurve, length_line], Reset=Button(), Threshold=1e-15, Tolerance=0.01, On=Toggle(True))  # -> I, V, O
