# Grasshopper definition gridrelax01b OnCurve(trimesh).gh (Grasshopper 1.0.7)
# plug-ins: Kangaroo2 Components, Weaverbird

mesh = Mesh(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)
wbtriangles = WeaverbirdsSplitTrianglesSubdivision(MeshCurves=mesh, Level=6)
wbjoin = WeaverbirdsJoinMeshesAndWeld(Mesh=wbtriangles, Weld=True)
medges = MeshEdges(Mesh=wbjoin)  # -> NakedEdges, InteriorEdges, NonManifoldEdges
relay = Relay([medges.InteriorEdges, medges.NakedEdges])
join = JoinCurves(Curves=medges.NakedEdges, Preserve=False)
item = ListItem(List=join, Index=0, Wrap=True)  # -> Item, Item1
explode = Explode(Curve=item.Item, Recursive=True)  # -> Segments, Vertices
end = EndPoints(Curve=explode.Segments)  # -> Start, End
crv = Curve(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)
strength = Strength(1000)

oncurve = OnCurve(Points=end.Start, Curve=crv, Strength=strength)
length_line = LengthLine(Line=relay, Length=0, Strength=0.01)
show = Show(G=wbjoin)

solver = Solver(GoalObjects=[show, oncurve, length_line], Reset=Button(), Threshold=1e-15, Tolerance=0.01, On=Toggle(True))  # -> I, V, O
item_2 = ListItem(List=solver.O, Index=0, Wrap=True)
