# Grasshopper definition gridrelax02 OnCurveX2(error lack ref geo).gh (Grasshopper 1.0.7)
# plug-ins: Kangaroo2 Components

mesh = Mesh(<mesh referenced from the Rhino model>)
refine = Refine(Mesh=mesh, Level=1)
clean = CombineClean(Meshes=refine)
medges = MeshEdges(Mesh=clean)  # -> NakedEdges, InteriorEdges, NonManifoldEdges
join = JoinCurves(Curves=medges.NakedEdges, Preserve=False)
relay = Relay([medges.InteriorEdges, medges.NakedEdges])
item = ListItem(List=join, Index=0, Wrap=True)  # -> Item, Item1
explode = Explode(Curve=item.Item1, Recursive=True)  # -> Segments, Vertices
explode_2 = Explode(Curve=item.Item, Recursive=True)  # -> Segments, Vertices
end = EndPoints(Curve=explode.Segments)  # -> Start, End
end_2 = EndPoints(Curve=explode_2.Segments)  # -> Start, End
crv = Curve(<curve referenced from the Rhino model>)
strength = Strength(1000)
crv_2 = Curve(<curve referenced from the Rhino model>)
strength_2 = Strength(1000)
oncurve = OnCurve(Points=end_2.Start, Curve=crv, Strength=strength)
oncurve_2 = OnCurve(Points=end.Start, Curve=crv_2, Strength=strength_2)
length_line = LengthLine(Line=relay, Length=0, Strength=0.01)
show = Show(G=clean)
solver = Solver(GoalObjects=[show, oncurve, length_line, oncurve_2], Reset=Button(), Threshold=1e-15, Tolerance=0.01, On=Toggle(True))  # -> I, V, O
data = Data(solver.O)
