# Grasshopper definition Bending_gridshell Angle OnCurve Length Load .gh (Grasshopper 1.0.7)
# plug-ins: Kangaroo2 Components

mesh = Mesh(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)
medges = MeshEdges(Mesh=mesh)  # -> NakedEdges, InteriorEdges, NonManifoldEdges
demesh = DeconstructMesh(Mesh=mesh)  # -> Vertices, Faces, Colours, Normals
warpweft = WarpWeft(Mesh=mesh)  # -> Warp, Weft, NakedA, NakedB
relay = Relay([medges.NakedEdges, medges.InteriorEdges])

join = JoinCurves(Curves=warpweft.Weft, Preserve=False)
explode = Explode(Curve=join, Recursive=True)  # -> Segments, Vertices
shift = ShiftList(List=explode.Segments, Shift=1, Wrap=False)
short = ShortestList(ListA=explode.Segments, ListB=shift, TrimMode=2)  # -> ListA, ListB
angle = Angle(LineA=short.ListA, LineB=short.ListB, Strength=1)

join_2 = JoinCurves(Curves=warpweft.Warp, Preserve=False)
explode_2 = Explode(Curve=join_2, Recursive=True)  # -> Segments, Vertices
shift_2 = ShiftList(List=explode_2.Segments, Shift=1, Wrap=False)
short_2 = ShortestList(ListA=explode_2.Segments, ListB=shift_2, TrimMode=2)  # -> ListA, ListB
angle_2 = Angle(LineA=short_2.ListA, LineB=short_2.ListB, Strength=1)

crv = Curve(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)
pt = Point([Point(5, 17, 0), Point(6, 18, 0), Point(7, 19, 0), Point(8, 20, 0), Point(22, 20, 0), Point(23, 19, 0), Point(24, 18, 0), Point(25, 17, 0), Point(25, 8, 0), Point(24, 7, 0), Point(23, 6, 0), Point(22, 5, 0), Point(8, 5, 0), Point(7, 6, 0), Point(6, 7, 0), Point(5, 8, 0)])
Z = UnitZ(Factor=0.001)

length_line = LengthLine(Line=relay, Strength=Slider(10, range=10..1000))
load = Load(Point=demesh.Vertices, ForceVector=Z)
oncurve = OnCurve(Points=pt, Curve=crv, Strength=1)

reset = Button()
on = BooleanToggle(False)

solver = Solver(GoalObjects=[length_line, angle_2, angle, load, oncurve], Reset=reset, Threshold=1e-15, Tolerance=0.01, On=on)  # -> I, V, O
crv_2 = Curve(solver.O)
