# Grasshopper definition gridshell_drape AnchorXYZ SolidPointColide Length Load.gh (Grasshopper 1.0.7)
# plug-ins: Kangaroo2 Components, MeshEdit Components

# Increase this slider (after first running the
# relaxation with it set at 1) to enforce the
# length constraint more strongly.
number_slider = Slider(1, range=1..10)
mplane = MeshPlane(Boundary={Plane=PlaneXY(-10, -10, 11), Size=Domain2(u=0..20, v=0..20)}, WidthCount=10, HeightCount=10)  # -> Mesh, Area
# Fixing a point in the middle of the mesh to
# only move vertically stops it from sliding of
# the side of the sphere.
area = MeshArea(Mesh=mplane.Mesh)  # -> Area, Centroid
demesh = DeconstructMesh(Mesh=mplane.Mesh)  # -> Vertices, Faces, Colours, Normals
medges = MeshEdges(Mesh=mplane.Mesh)  # -> NakedEdges, InteriorEdges, NonManifoldEdges
Z = UnitZ(Factor=-0.01)
# This sphere can be replaced with
# a closed solid of any shape
sph = Sphere(Base=PlaneXY(0, 0, 0), Radius=10)
_10º = PowerOf10(Value=number_slider)
length_line = LengthLine(Line=[medges.NakedEdges, medges.InteriorEdges], Strength=_10º)
load = Load(Point=demesh.Vertices, ForceVector=Z)
spc = SolidPointCollide(Points=demesh.Vertices, Solid=sph, Interior=False, Unidirectional=True, Strength=1)
anchorxyz = AnchorXYZ(Point=area.Centroid, X=True, Y=True, Z=False, Strength=1000)
reset = Button()
solver = Solver(GoalObjects=[length_line, load, spc, anchorxyz], Reset=reset, Threshold=1e-15, Tolerance=0.01, On=Toggle(False))  # -> I, V, O
crv = Curve(solver.O)
len = Length(Curve=crv)
panel = Panel(len)
