# Grasshopper definition Hinged_dissection CurveColide RigidPointSet OnPlane.gh (Grasshopper 1.0.8)
# plug-ins: NGon, Kangaroo2 Components

crv = Curve([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])
explode = Explode(Curve=crv, Recursive=True)  # -> Segments, Vertices
end = EndPoints(Curve=explode.Segments)  # -> Start, End

cc = CurveCollide(Curves=crv, BasePlane=PlaneXY(0, 0, 0), Strength=1)  # -> Goal, Frames
show = Show(G=explode.Segments)
onplane = OnPlane(Points=end.Start, Plane=PlaneXY(0, 0, 0), Strength=1)
grab = Grab(On=True, Strength=1, Range=3)
rigidpointset = RigidPointSet(Points=end.Start, Plane=graft(cc.Frames), Strength=10)  # -> RigidBody, Planes

entwine = Entwine(Branch00=show, Branch01=flatten([cc.Goal, rigidpointset.RigidBody, grab, onplane]), FlattenInputs=True)
solver = Solver(GoalObjects=entwine, Reset=Button(), Threshold=1e-15, Tolerance=0.0001, On=Toggle(True))  # -> I, V, O
dot = DotDisplay(Point=solver.V)
tree_branch = TreeBranch(T=solver.O, i=0)  # -> _1, _0
join = JoinCurves(Curves=tree_branch._1, Preserve=False)
panel = Panel(tree_branch._1)
fromp = FromPolylines(Curves=graft(join), Min_Triangulation=True)  # -> flatten(Mesh)
colourful = Colourful(geo=fromp)

# ==== cluster Colourful: Display objects in bright colours
geo = ClusterInput()
geo_2 = Geometry(geo)
clean = CleanTree(RemoveNulls=True, RemoveInvalid=True, RemoveEmpty=False, Tree=flatten(geo_2))
S = Shader([{diffuse=RGB(11, 125, 222), emission=RGB(3, 38, 67), shine=0.5, specular=RGB(255, 255, 255), transparency=0}, {diffuse=RGB(222, 37, 11), emission=RGB(67, 11, 3), shine=0.5, specular=RGB(255, 255, 255), transparency=0}, {diffuse=RGB(71, 222, 11), emission=RGB(21, 67, 3), shine=0.5, specular=RGB(255, 255, 255), transparency=0}, {diffuse=RGB(222, 194, 11), emission=RGB(67, 58, 3), shine=0.5, specular=RGB(255, 255, 255), transparency=0}])
lng = ListLength(List=clean)
repeat = RepeatData(Data=S, Length=lng)
preview = CustomPreview(Geometry=clean, Shader=repeat)

# ==== cluster TreeBranch: Select tree branches using index of the path True branches are WHITE Others are Black Created By Quan Li
i = ClusterInput()  # Branch Index
T = ClusterInput()  # Tree
data = Data(T)
branch_index = Integer(i)
tstat = TreeStatistics(Tree=data)  # -> Paths, Length, Count
cull_i = CullIndex(List=tstat.Paths, Indices=branch_index, Wrap=True)
item = ListItem(List=tstat.Paths, Index=branch_index, Wrap=True)
branch = TreeBranch(Tree=data, Path=item, MaintainPaths=True)
branch_2 = TreeBranch(Tree=data, Path=cull_i, MaintainPaths=True)
preview = CustomPreview(Geometry=branch, Material=ColourSwatch(SwatchColor=RGB(255, 255, 255)))
_1 = ClusterOutput(branch)  # The branches correspondent to the input branch index
_0 = ClusterOutput(branch_2)  # The branches NOT correspondent to the input branch index
preview_2 = CustomPreview(Geometry=branch_2, Material=ColourSwatch(SwatchColor=RGB(66, 66, 66)))
