# Grasshopper definition strandbeest Anchor Length(Line)gh.gh (Grasshopper 1.0.7)
# plug-ins: Kangaroo2 Components, pOd_Animation, Vipers

timer = Timer(Interval=20, TimerInterval=20, Target=counter)
counter = POd_Counter(
    Trigger=Toggle(False),
    Start=0,
    End=10,
    Count=10,
    Reset=Button(),
    ButtonActive=False,
    ButtonContinue=True,
    ButtonInverse=False,
    ButtonRestart=False,
    ButtonStop=False)
knob = ControlKnob(Decimals=2, Limit=False, Maximum=10, Minimum=0, Range=0.2, Value=0.03)
panel = Panel(counter)
num = Number(knob)
multiplication = Multiplication(A=panel, B=num)
panel_2 = Panel(num)

crv = Curve([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])
pt = Point([Point(38.37953562, 63.10049538, 0), Point(63.35407149, 63.10049538, 0)])
pt_2 = Point(Point(45.96265117, 65.74097308, 0))
O = Origin(Point(50.86680355, 65.74098193, 0))
xy = XYPlane(Origin=O)
panel_3 = Panel(multiplication)
rotate = Rotate(Geometry=pt_2, Angle=expr("-x", multiplication), Plane=xy)  # -> Geometry, Transform
grab = Grab(On=True, Strength=1, Range=3)

anchor = Anchor(Point=[pt, O], Strength=10000)
anchor_2 = Anchor(Point=pt_2, Target=rotate.Geometry, Strength=1)
length_line = LengthLine(Line=crv, Strength=1)

solver = Solver(GoalObjects=[length_line, anchor, anchor_2, grab], Reset=Button(), Threshold=1e-15, Tolerance=0.01, On=Toggle(True))  # -> I, V, O
item = ListItem(List=solver.V, Index=[3, 11], Wrap=True)  # -> graft(Item)
clean = CleanTree(RemoveNulls=True, RemoveInvalid=True, RemoveEmpty=False, Tree=solver.O)
randomgeometrycolor = RandomColor(Property=graft(clean), Colour=RGB(255, 255, 0), Seed=0)
rec = DataRecorder(item, DataLimit=50, RecordData=True)
panel_4 = Panel(item)
cloud = CloudDisplay(Points=rec, Colours=RGB(255, 20, 147), Size=1, SpriteType=0)
