# Grasshopper definition Raisin Volume SphereColide.gh (Grasshopper 1.0.7)
# plug-ins: Weaverbird, Kangaroo2 Components

wbicosahedron = WeaverbirdsMeshMeshIcosahedron(Plane=PlaneXY(0, 0, 0), Radius=5)
wbloop = WeaverbirdsLoopSubdivision(MeshCurves=wbicosahedron, Level=3, SmoothNakedEdges=1)
mesh = Mesh(wbloop)
medges = MeshEdges(Mesh=mesh)  # -> NakedEdges, InteriorEdges, NonManifoldEdges
len = Length(Curve=medges.InteriorEdges)
avr = Average(Input=len)
volume = Volume(Geometry=mesh)  # -> Volume, Centroid
demesh = DeconstructMesh(Mesh=mesh)  # -> Vertices, Faces, Colours, Normals
multiplication = Multiplication(A=avr, B=Slider(0.74, range=0..1))
multiplication_2 = Multiplication(A=Slider(0.647, range=0..1), B=volume.Volume)

show = Show(G=mesh)
volume_2 = Volume(Mesh=mesh, Volume=multiplication_2, Strength=0.2)
smooth = Smooth(M=mesh, Strength=0.1)
sc = SphereCollide(Points=demesh.Vertices, Radius=multiplication, Strength=10)
length_line = LengthLine(Line=medges.InteriorEdges, Strength=1)

reset = Button()
solver = Solver(GoalObjects=[volume_2, length_line, show, smooth, sc], Reset=reset, Threshold=1e-15, Tolerance=0.01, On=Toggle(True))  # -> I, V, O
item = ListItem(List=solver.O, Index=1, Wrap=True)
wbloop_2 = WeaverbirdsLoopSubdivision(MeshCurves=item, Level=2, SmoothNakedEdges=1)
preview = CustomPreview(
    Geometry=wbloop_2,
    Shader={diffuse=RGB(250, 250, 250), emission=RGB(0, 0, 0), shine=0, specular=RGB(255, 255, 255), transparency=0})
