# Grasshopper definition drape_expanding_triangles VertexLoad SolidPointColide Length(Line).gh (Grasshopper 1.0.7)
# plug-ins: Kangaroo2 Components

trigrid = Triangular(Plane=PlaneXY(0, 0, 0), Size=1, ExtentX=18, ExtentY=12)  # -> Cells, Points
smesh = SimpleMesh(Brep=trigrid.Cells)
move = Move(Geometry=smesh, Motion=Vector(0, 0, 3))  # -> Geometry, Transform
clean = CombineClean(Meshes=flatten(move.Geometry))
faceb = FaceBoundaries(Mesh=clean)
checkerboard = Checkerboard(Mesh=clean)
subtraction = Subtraction(A=1, B="0.1")
explode = Explode(Curve=faceb, Recursive=True)  # -> Segments, Vertices
item = ListItem(List=["0.1", subtraction], Index=checkerboard, Wrap=True)  # -> graft(Item)
item_2 = ListItem(List=[0, 1], Index=checkerboard, Wrap=True)  # -> graft(Item)
eval = EvaluateCurve(Curve=reparameterize(explode.Segments), Parameter=item)  # -> Point, Tangent, Angle
eval_2 = EvaluateCurve(Curve=reparameterize(explode.Segments), Parameter=item_2)  # -> Point, Tangent, Angle
pline = PolyLine(Vertices=eval.Point, Closed=True)
smesh_2 = SimpleMesh(Brep=pline)  # -> flatten(Mesh)
ln = Line(StartPoint=eval.Point, EndPoint=eval_2.Point)
explode_2 = Explode(Curve=pline, Recursive=True)  # -> Segments, Vertices
clean_2 = CombineClean(Meshes=smesh_2)
demesh = DeconstructMesh(Mesh=clean_2)  # -> Vertices, Faces, Colours, Normals
brep = Brep(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)

vertexloads = VertexLoads(Mesh=clean_2, Strength=-0.01)
floor = Floor(Strength=1)
spc = SolidPointCollide(Points=demesh.Vertices, Solid=brep, Interior=False, Unidirectional=True, Strength=1)
length_line = LengthLine(Line=explode_2.Segments, Strength=1000)
length_line_2 = LengthLine(Line=ln, Strength="0.1")
show = Show(G=clean_2)

entwine = Entwine(Branch00=show, Branch01=[length_line, length_line_2, floor, vertexloads, spc], FlattenInputs=True)
solver = Solver(GoalObjects=entwine, Reset=Button(), Threshold=1e-15, Tolerance=0.01, On=Toggle(False))  # -> I, V, O
bang = ExplodeTree(Data=solver.O)  # -> Branch0, Branch1
mesh = Mesh(bang.Branch0)
