# Grasshopper definition hyperbolic SphereColide Smooth Length(Line).gh (Grasshopper 1.0.7)
# plug-ins: Kangaroo2 Components, Weaverbird

mesh = Mesh(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)
medges = MeshEdges(Mesh=mesh)  # -> NakedEdges, InteriorEdges, NonManifoldEdges
number_slider = Slider(1, range=1..3)
demesh = DeconstructMesh(Mesh=mesh)  # -> Vertices, Faces, Colours, Normals
crv = Curve([medges.NakedEdges, medges.InteriorEdges])
len = Length(Curve=crv)
addition = Addition(A=number_slider, B=number_slider)

# ---- group: reduce slider to 0 to make all edges same length
number_slider_2 = Slider(0.549, range=0..1)

# ----
subtraction = Subtraction(A=len, B=addition)
multiplication = Multiplication(A=subtraction, B=number_slider_2)
addition_2 = Addition(A=multiplication, B=addition)

show = Show(G=mesh)
smooth = Smooth(M=mesh, Strength=1)
length_line = LengthLine(Line=crv, Length=addition_2, Strength=1000)
sc = SphereCollide(Points=demesh.Vertices, Radius=number_slider, Strength=1)
grab = Grab(On=True, Strength=1, Range=3)  # -> Grab, Anchors

reset = Button()
simulate = BooleanToggle(False)
solver = Solver(GoalObjects=[length_line, smooth, grab.Grab, show, sc], Reset=reset, Threshold=1e-10, Tolerance=0.01, On=simulate)  # -> I, V, O
bang = ExplodeTree(Data=solver.O)  # -> Branch0, Branch1
mesh_2 = Mesh(bang.Branch0)
wbloop = WeaverbirdsLoopSubdivision(MeshCurves=mesh_2, Level=Slider(3, range=1..3), SmoothNakedEdges=1)
