# Grasshopper definition pullmesh_to_surface OnMesh.gh (Grasshopper 1.0.7)
# plug-ins: Kangaroo2 Components

W = WidthCount(30)
mplane = MeshPlane(Boundary={Plane=PlaneXY(-21, -17, 0), Size=Domain2(u=0..71, v=0..44)}, WidthCount=W, HeightCount=W)  # -> Mesh, Area
demesh = DeconstructMesh(Mesh=mplane.Mesh)  # -> Vertices, Faces, Colours, Normals
medges = MeshEdges(Mesh=mplane.Mesh)  # -> NakedEdges, InteriorEdges, NonManifoldEdges
srf = Surface(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)
crv = Curve([medges.NakedEdges, medges.InteriorEdges])

length_line = LengthLine(Line=crv, Strength=10)
onmesh = OnMesh(Points=demesh.Vertices, Mesh=srf, Strength=1)
smooth = Smooth(M=mplane.Mesh, Strength=10)

solver = Solver(GoalObjects=[length_line, onmesh, smooth], Reset=Button(), Threshold=1e-15, Tolerance=0.01, On=Toggle(False))  # -> I, V, O
data = Data(solver.O)
