# Grasshopper definition simple_4bar_linkage Length(line) Anchor.gh (Grasshopper 1.0.7)
# plug-ins: Kangaroo2 Components

# ---- group: This fixes some chosen vertices in place.
pt = Point([Point(16, 11, 0), Point(25, 13, 0)])
anchor = Anchor(Point=pt, Strength=10000)

# ----
crv = Curve([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])

# ---- group: This keeps all vertices on the XY plane
explode = Explode(Curve=crv, Recursive=True)  # -> Segments, Vertices
cullpt = CullDuplicates(Points=flatten(explode.Vertices), Tolerance=0.1, CullMode=3)  # -> Points, Indices, Valence
onplane = OnPlane(Points=cullpt.Points, Plane=PlaneXY(0, 0, 0), Strength=1)

# ---- group: This lets us drag the vertices of the linkage in the Rhino viewport (using Alt+Left mouse button)
grab = Grab(On=True, Strength=0.1, Range=3)  # -> Grab, Anchors

# ---- group: this maintains the lengths of the line segments
length_line = LengthLine(Line=crv, Strength=10)

# ----
solver = Solver(GoalObjects=[length_line, anchor, grab.Grab, onplane], Reset=Button(), Threshold=1e-15, Tolerance=0.01, On=True)  # -> I, V, O
