# Grasshopper definition balance_solid SplidePlaneColide RigidBody Load.gh (Grasshopper 1.0.7)
# plug-ins: Kangaroo2 Components

brep = Brep(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)
rigidbody = RigidBody(Part=brep, Strength=10)  # -> RigidBody, Planes
xy = XYPlane(Origin=Point(0, 0, 0))
pt = Point(rigidbody.Planes)
solidplanecollide = SolidPlaneCollide(Solid=brep, SolidPlane=rigidbody.Planes, CollisionPlane=xy, Strength=1)
Z = UnitZ(Factor=-0.1)
load = Load(Point=pt, ForceVector=Z)
bouncysolver = BouncySolver(
    GoalObjects=[solidplanecollide, rigidbody.RigidBody, load],
    Reset=Button(),
    Threshold=1e-15,
    Tolerance=0.01,
    Damping=0.97,
    Iterations=20,
    On=Toggle(False))  # -> I, V, O
preview = CustomPreview(
    Geometry=bouncysolver.O,
    Shader={diffuse=RGB(0, 192, 192), emission=RGB(0, 0, 0), shine=0.5, specular=RGB(255, 255, 255), transparency=0})
