# Grasshopper definition TensileRelaxScript TensileRelax.gh (Grasshopper 1.0.7)

mesh = Mesh(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)
tensilerelax = TensileRelax(M=mesh, Reference="C:\PROGRAM FILES\RHINO 7\PLUG-INS\GRASSHOPPER\COMPONENTS\KangarooSolver.dll")  # -> out, A, B; inputs M: Mesh
# ---------- tensilerelax: C# ----------
    //initialize the solver
    var PS = new KangarooSolver.PhysicalSystem();
    var Goals = new List<IGoal>();

    //get the Mesh points and boundary status
    Point3d[] Pts = M.Vertices.ToPoint3dArray();
    bool[] Naked = M.GetNakedEdgePointStatus();

    for(int i = 0; i < M.Vertices.Count;i++)
    {
      PS.AddParticle(Pts[i], 1); //add a particle for every mesh vertex
      if(Naked[i])
      {Goals.Add(new KangarooSolver.Goals.Anchor(i, Pts[i], 10000));}// fix the boundaries strongly in place
    }

    for(int i = 0; i < M.TopologyEdges.Count;i++)
    {
      var Ends = M.TopologyEdges.GetTopologyVertices(i);
      int Start = M.TopologyVertices.MeshVertexIndices(Ends.I)[0];
      int End = M.TopologyVertices.MeshVertexIndices(Ends.J)[0];
      Goals.Add(new KangarooSolver.Goals.Spring(Start, End, 0, 1)); //for each edge, a spring with rest length 0, and strength 1
    }

    int counter = 0;
    double threshold = 1e-6;
    do
    {
      //Step forward, using these goals, with multi-threading on, and stopping if the threshold is reached
      PS.Step(Goals, true, threshold);
      counter++;
    }while(PS.GetvSum() > threshold && counter < 100);
    //GetvSum returns the current kinetic energy
    //always include a counter to prevent it getting stuck forever in case it cannot reach the given threshold

    //replace the mesh vertices with the relaxed ones
    M.Vertices.Clear();
    M.Vertices.AddVertices(PS.GetPositions());

    //Output the mesh, and how many iterations it took to converge
    A = M;
    B = counter;
# ---------- end tensilerelax ----------
