# Grasshopper definition mesh_flatten HingePoints Hinge.gh (Grasshopper 1.0.7)
# plug-ins: Kangaroo2 Components

srf = Surface(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)
mesh = Mesh(srf)
medges = MeshEdges(Mesh=mesh)  # -> NakedEdges, InteriorEdges, NonManifoldEdges
hingepoints = HingePoints(Mesh=mesh)  # -> _1, _2, _3, _4
demesh = DeconstructMesh(Mesh=mesh)  # -> Vertices, Faces, Colours, Normals
Z = UnitZ(Factor=-0.01)

grab = Grab(On=True, Strength=1, Range=3)  # -> Grab, Anchors
length_line = LengthLine(Line=[medges.NakedEdges, medges.InteriorEdges], Strength=Slider(0.021, range=0..1))
show = Show(G=mesh)
hinge = Hinge(FoldStart=hingepoints._1, FoldEnd=hingepoints._2, Tip1=hingepoints._3, Tip2=hingepoints._4, RestAngle=0, Strength=1)
floor = Floor(Strength=1)
load = Load(Point=demesh.Vertices, ForceVector=Z)

solver = Solver(
    GoalObjects=[length_line, hinge, show, floor, load, grab.Grab],
    Reset=Button(),
    Threshold=1e-15,
    Tolerance=0.01,
    On=Toggle(False))  # -> I, V, O
data = Data(solver.O)
item = ListItem(List=data, Index=0, Wrap=True)
preview = CustomPreview(
    Geometry=item,
    Shader={diffuse=RGB(0, 192, 0), emission=RGB(76, 32, 54), shine=0.5, specular=RGB(255, 255, 255), transparency=0})
medges_2 = MeshEdges(Mesh=item)  # -> NakedEdges, InteriorEdges, NonManifoldEdges
