# Grasshopper definition mesh_shell HingePoints Hinge Length(Line).gh (Grasshopper 1.0.7)
# plug-ins: Kangaroo2 Components

mesh = Mesh(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)
hingepoints = HingePoints(Mesh=mesh)  # -> _1, _2, _3, _4
medges = MeshEdges(Mesh=mesh)  # -> NakedEdges, InteriorEdges, NonManifoldEdges
hinge = Hinge(FoldStart=hingepoints._1, FoldEnd=hingepoints._2, Tip1=hingepoints._3, Tip2=hingepoints._4, Strength=1)
grab = Grab(On=True, Strength=1, Range=3)  # -> Grab, Anchors
length_line = LengthLine(Line=[medges.NakedEdges, medges.InteriorEdges], Strength=1)
show = Show(G=mesh)
solver = Solver(GoalObjects=[length_line, hinge, show, grab.Grab], Reset=Button(), Threshold=1e-15, Tolerance=0.01, On=True)  # -> I, V, O
data = Data(solver.O)
preview = CustomPreview(
    Geometry=data,
    Shader={diffuse=RGB(0, 192, 0), emission=RGB(76, 32, 54), shine=0.5, specular=RGB(255, 255, 255), transparency=0})
