# Grasshopper definition Diagonal Grid and Aligned Grid in Loaded Net Structure Diagonal Anchor.gh (Grasshopper 1.0.7)
# plug-ins: Kangaroo2 Components

W = WidthCount(20)
# https://discourse.mcneel.com/t/frei-otto-hanging-model/167730/2?u=quan_li
# 
# 
# Daniel Piker
# McNeel
# 15m
# 
# Hi @Mario_B
# 
# Yes, the orientation of the mesh edges will make a big difference to the shape of a hanging net.
# 
# There are a number of other factors that will affect the shape.
# When you start with a flat grid there are several ways you can allow it to hang:
# 
# -One is to strongly preserve the edge lengths (by giving them a high strength) and move the corners inwards.
# -Another is to keep the corners fixed and increase the rest length of the edges while keeping their strength high. This will give the same shape as the first option, but at a different size.
# -A third is to keep the corners fixed, the rest lengths the same, but use a lower strength for preserving the edge lengths. This simulates a more stretchy grid, unlike the first 2 options which can be thought of more as a net of chains. This will give a smoother shape with more variation in edge lengths.
# 
# The difference between 1/2 and 3 is more apparent when using a diagonal grid compared to one aligned with the boundaries, as for the diagonal grid, strict edge length preservation leads to ridges and even wrinkles, which doesn’t occur for the aligned grid.
# 
# Playing with the sliders here will show this:
# hanging_diagonal.gh (12.3 KB)
# 
# Aside from this there’s the question of whether you fix a single point at each corner or a row.
# 
# Also it isn’t totally clear from the image, but it looks like maybe in that model there are different loads applied along the outer edge?
mplane = MeshPlane(Boundary={Plane=PlaneXY(0, 0, 0), Size=Domain2(u=-10..10, v=-10..10)}, WidthCount=W, HeightCount=W)  # -> Mesh, Area
diag = Diagonalize(Mesh=mplane.Mesh)
filter = StreamFilter(Gate=Toggle(True), Stream0=mplane.Mesh, Stream1=diag)
demesh = DeconstructMesh(Mesh=filter)  # -> Vertices, Faces, Colours, Normals
mc = MeshCorners(Mesh=filter, Angle=2.35619449)
dist = Distance(PointA=graft(demesh.Vertices), PointB=mc)
sort = SortList(Keys=dist)  # -> Keys, ValuesA
item = ListItem(List=sort.Keys, Index=0, Wrap=True)
smaller = SmallerThan(FirstNumber=item, SecondNumber=Slider(1.783, range=0..4))  # -> flatten(SmallerThan), OrEqualTo
cull = CullPattern(List=demesh.Vertices, CullPattern=smaller.SmallerThan)

show = Show(G=filter)
anchor = Anchor(Point=cull, Strength=10000)
edgelengths = EdgeLengths(Mesh=filter, LengthFactor=Slider(1, range=0..2), Strength=Slider(5.535, range=1..100))
vertexloads = VertexLoads(Mesh=filter, Strength=Slider(0.079, range=0..2))

entwine = Entwine(Branch00=show, Branch01=[anchor, edgelengths, vertexloads], FlattenInputs=True)
solver = Solver(GoalObjects=entwine, Reset=Button(), Threshold=1e-15, Tolerance=0.0001, On=True)  # -> I, V, O
bang = ExplodeTree(Data=solver.O)  # -> Branch0, Branch1
mesh = Mesh(bang.Branch0)
