# Grasshopper definition SimpleTensile EdgeLength.gh (Grasshopper 1.0.7)
# plug-ins: Kangaroo2 Components

mplane = MeshPlane(Boundary={Plane=PlaneXY(0, 0, 0), Size=Domain2(u=-10..10, v=-10..10)}, WidthCount=10, HeightCount=10)  # -> Mesh, Area
# If you have the 'gumball' option on in the
# Grasshopper display menu, when you
# select these points you should be able to
# move them in the Rhino display port.
pt = Point([Point(-10, 10, 11.98317351), Point(10, 10, 0), Point(10, -10, 11.49471948), Point(-10, -10, 1.812405629)])
# The 'P' input of the Anchor identifies
# which points to move, and the 'T'
# input tells it where to move them to.
mc = MeshCorners(Mesh=mplane.Mesh, Angle=2.35619449)
edgelengths = EdgeLengths(Mesh=mplane.Mesh, LengthFactor=Slider(0.25, range=0..1), Strength=1)
anchor = Anchor(Point=mc, Target=pt, Strength=10000)
solver = Solver(GoalObjects=[edgelengths, anchor], Reset=False, Threshold=1e-15, Tolerance=0.01, On=True)  # -> I, V, O
