# Grasshopper definition SoapFilm SoapFilm TangentialSmooth.gh (Grasshopper 1.0.7)
# plug-ins: Kangaroo2 Components

mesh = Mesh(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)
tri = Triangulate(Mesh=mesh)  # -> Mesh, Count
nv = NakedVertices(Mesh=mesh)  # -> ClothedIndex, NakedIndex, ClothedPts, NakedPts
faceb = FaceBoundaries(Mesh=tri.Mesh)
show = Show(G=tri.Mesh)
explode = Explode(Curve=faceb, Recursive=True)  # -> Segments, Vertices
end = EndPoints(Curve=explode.Segments)  # -> Start, End

anchor = Anchor(Point=nv.NakedPts, Strength=1000)
sg = SoapFilm(Pts=end.Start, Strength=1)
tsmooth = TangentialSmooth(M=mesh, Strength=10)

solver = Solver(GoalObjects=[sg, show, anchor, tsmooth], Reset=Button(), Threshold=1e-15, Tolerance=0.01, On=True)  # -> I, V, O
data = Data(solver.O)
