# Grasshopper definition Tensile WarpWeft Different Stength.gh (Grasshopper 1.0.7)
# plug-ins: Kangaroo2 Components

# ---- group: Reverse/Rotate Selected Polylines in Rhino
reverse = Button()
rotate = Button()
rrp = ReverseRotatePolyline(Reverse=reverse, Rotate=rotate)
# ---------- rrp: Python ----------
"""
Reverse or Rotate Selected Polylines in Rhino Document.
    Remarks:
        Author: Anders Holden Deleuran
        License: Apache License 2.0
        Rhino: 6.17.19204.4491
        Version: 200917
"""

import Rhino as rc
import scriptcontext as sc
import rhinoscriptsyntax as rs
import Grasshopper as gh
import collections

ghenv.Component.Name = "ReverseRotatePolyline"""
ghenv.Component.NickName = "RRP"

def reversePolyline(polyline):
    
    """ Reverses the vertex order of polyline """
    
    vts = list(polyline)
    vts.pop(-1)
    vts.reverse()
    vts.append(vts[0])
    revPl = rc.Geometry.Polyline(vts)
    
    return revPl

def rotatePolyline(polyline):
    
    """ Offsets vertex order of polyline """
    
    vts = list(polyline)
    vts.pop(-1)
    vts = collections.deque(vts)
    vts.rotate()
    vts.append(vts[0])
    rotPl = rc.Geometry.Polyline(vts)
    
    return rotPl

sc.doc = rc.RhinoDoc.ActiveDoc
for selObj in rs.SelectedObjects():
    layer = rs.ObjectLayer(selObj)
    if selObj:
        if rs.ObjectType(selObj) == 4:
            selCrv = rs.coercecurve(selObj)
            test,selPl = selCrv.TryGetPolyline()
            if test:
                if Reverse:
                    revPl = reversePolyline(selPl)
                    rs.AddPolyline(revPl,selObj)
                if Rotate:
                    rotPl = rotatePolyline(selPl)
                    rs.AddPolyline(rotPl,selObj)
# ---------- end rrp ----------

# ----
# Created By AndersDeleuran
# https://discourse.mcneel.com/u/andersdeleuran/summary
# 
# https://discourse.mcneel.com/t/minimal-surfaces/87241/120
# Get Quads From Rhino
crv = Curve([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])

quads = Curve([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])

# ---- group: Gridify, Mesh and Map Quads
# Discretise and Map Quads
number_slider = Slider(1, range=0.01..10)
mode = ValueList({"EdgeLength": "edgeLength", "Divisions": "divisions"}, selected="Divisions")
quads_2 = Curve(crv)
mgq = MeshGridifyQuads(Quads=quads_2, EdgeLength=number_slider, Divisions=Slider(10, range=0..100), Mode=mode)  # -> Quads, SubDMesh, SubDMaps; inputs Quads: list
# ---------- mgq: Python ----------
"""
Gridify and mesh a list of closed quadrilateral polylines toward a target mesh
length. The algorithm uses the lengths of the two first segments of each quad to
compute UV subdivision counts.
    Inputs:
        Quads: Closed polyline quads to gridify and mesh {list,polyline}
        EdgeLength: Target mesh edge length {item,float}
    Outputs:
        SubDMesh: The subdivided quad mesh {item,mesh}
        SubDMap: Dictionaries mapping each of the subdivided quads {list,dict}
    Remarks:
        Author: Anders Holden Deleuran (BIG IDEAS)
        Rhino: 6.17.19204.4491
        Version: 200917
"""

import Rhino as rc

ghenv.Component.Name = "MeshGridifyQuads"
ghenv.Component.NickName = "MGQ"

def divideCurve(crv,count,includeEnds):
    
    """ Divide curve similar to the one Grasshopper """
    
    params = crv.DivideByCount(count,includeEnds)
    pts = [crv.PointAt(t) for t in params]
    
    return pts

def meshGrid(points,ptsU,ptsV):
    
    """ Make a quad mesh from a grid of points """ 
    
    if len(points) == ptsU*ptsV:
        
        # Make mesh and add vertices
        mesh = rc.Geometry.Mesh()
        mesh.Vertices.AddVertices(rc.Collections.Point3dList(points))
        
        # Add faces
        for i in range(ptsU-1):
            for j in range(0,ptsU*(ptsV-1),ptsU):
                ij = i+j
                mesh.Faces.AddFace(ij, ij+ptsU, ij+ptsU+1, ij+1)
                
        # Compute normals and return
        mesh.Normals.ComputeNormals()
        
        return mesh

def subdivideAndMeshQuad(quadCrv,edgeLength,divisions,mode):
    
    """ Subdivides a quad polyline curve using a target mesh edgeLength """
    
    # Cast curve to polyline and get/check segments/count
    test,pl = quadCrv.TryGetPolyline()
    segs = pl.GetSegments()
    if len(segs) == 4:
        
        # Assign sides and compute subdivisions for even/odd pairs
        s0,s1,s2,s3 = segs
        subdEven = int(s0.Length/edgeLength)
        subdOdd = int(s1.Length/edgeLength)
        
        if mode == "divisions":
            subdEven = divisions
            subdOdd = divisions
        
        # Subdivide even sides
        s0Pts = divideCurve(s0.ToNurbsCurve(),subdEven,True)
        s2Pts = divideCurve(s2.ToNurbsCurve(),subdEven,True)
        s2Pts.reverse()
        
        # Generate grid points
        gridPts = []
        for s0Pt,s2Pt in zip(s0Pts,s2Pts):
            l = rc.Geometry.Line(s0Pt,s2Pt)
            oddPts = divideCurve(l.ToNurbsCurve(),subdOdd,True)
            gridPts.extend(oddPts)
            
        # Mesh grid points
        quadMesh = meshGrid(gridPts,subdOdd+1,subdEven+1)
        
        # Pack UV counts
        uv = (subdEven,subdOdd)
        
        return quadMesh,uv

def joinMeshes(meshes):
    
    """ Append a list of meshes and join vertices, build normals etc. """
    
    jMesh = rc.Geometry.Mesh()
    for me in meshes:
        jMesh.Append(me)
        
    #jMesh.UnifyNormals()
    jMesh.Vertices.CombineIdentical(True,True)
    jMesh.Weld(rc.RhinoMath.ToRadians(180))
    jMesh.Normals.ComputeNormals()
    
    return jMesh

def getVertexIDsMeshOnMesh(subMesh,mesh):
    
    """ Map the vertices of subMesh onto the vertices of mesh """
    
    # Get vertices and make search collection
    mpPts = subMesh.Vertices.ToPoint3dArray()
    mPts = mesh.Vertices.ToPoint3dArray()
    mPts = rc.Collections.Point3dList(mPts)
    
    # Map the indices
    indices = []
    for pt in mpPts:
        id = mPts.ClosestIndex(pt)
        indices.append(id)
        
    return indices

# Check inputs
if Quads:
    
    # Generate subdivided meshes and get their UV counts
    subdMeshes = []
    subdUVs = []
    for q in Quads:
        qm,uv = subdivideAndMeshQuad(q,EdgeLength,int(Divisions),Mode)
        subdMeshes.append(qm)
        subdUVs.append(uv)
        
    # Join subdivided meshes and get naked vertices
    macroMesh = joinMeshes(subdMeshes)
    
    # Map subdivided meshes onto macroMesh (as dict with uv and vtsMap as keys)
    subdMaps = []
    for sm,uv in zip(subdMeshes,subdUVs):
        vtsMap = getVertexIDsMeshOnMesh(sm,macroMesh)
        subdMaps.append({"uv": uv, "vtsMap": vtsMap})
        
    # Output to GH
    SubDMesh = macroMesh
    SubDMaps = subdMaps
else:
    SubDMesh = []
    SubDMaps = []
# ---------- end mgq ----------

# ---- group: Send Subdivided Mesh to Form Finding
passdata = BooleanToggle(True)
subdmesh = Mesh(mgq.SubDMesh)
pd = PassData(Toggle=passdata, Data=subdmesh)  # -> Data; inputs Data: tree
# ---------- pd: Python ----------
ghenv.Component.Name = "PassData"
ghenv.Component.NickName = "PD"

if Toggle:
    Data = Data
else:
    Data = []
# ---------- end pd ----------
subdmesh_2 = Mesh(pd)

# ---- group: Draw Quads and SubDMesh Topology
passdata_2 = Boolean(invert(passdata))
subdmesh_3 = Mesh(mgq.SubDMesh)
quads_3 = Curve(mgq.Quads)
dt = DrawTopology(Toggle=passdata_2, Quads=quads_3, SubDMesh=subdmesh_3)  # inputs Quads: list
# ---------- dt: Python ----------
"""
Draw Quads and SubDMesh Topology
    Remarks:
        Author: Anders Holden Deleuran
        License: Apache License 2.0
        Rhino: 6.17.19204.4491
        Version: 200917
"""

from ghpythonlib.componentbase import executingcomponent as component
import Rhino as rc
from System.Drawing import Color

ghenv.Component.Name = "DrawTopology"
ghenv.Component.NickName = "DT"

class MyComponent(component):
    
    def RunScript(self,Toggle,Quads,SubDMesh):
        
        # Toggle preview
        if Toggle:
            ghenv.Component.Hidden = False
        else:
            ghenv.Component.Hidden = True
            
        if Quads and SubDMesh:
            
            # Assign variables and call methods
            self.mesh = SubDMesh
            self.scaling = 0.90
            self.thick = 4
            self.nakedEdges = SubDMesh.GetNakedEdges()
            self.setMeshRenderProperties()
            if Quads:
                self.quadAxes = [self.getQuadAxes(plc) for plc in Quads]
            
    def setMeshRenderProperties(self):
        
        # Set front colors
        self.material = rc.Display.DisplayMaterial(Color.Black)
        self.material.Emission = Color.FromArgb(255,235,235,235)
        
        # Color back faces
        self.material.IsTwoSided = True
        self.material.BackDiffuse = Color.Black
        self.material.BackEmission = Color.FromArgb(255,255,125,0)
        
    def getQuadAxes(self,quad):
        
        """ Scale the polyline inwards and get first two edges """
        
        test,pl = quad.TryGetPolyline()
        ct = pl.CenterPoint()
        tr = rc.Geometry.Transform.Scale(ct,self.scaling)
        pl.Transform(tr)
        segs = pl.GetSegments()
        axes = segs[0:2]
        return axes
        
    def DrawViewportMeshes(self,arg):
        if self.mesh:
            arg.Display.DrawMeshShaded(self.mesh,self.material)
            
    def DrawViewportWires(self,arg):
        if self.mesh:
            arg.Display.DrawMeshWires(self.mesh,Color.FromArgb(255,200,200,200),1)
            for pl in self.nakedEdges:
                arg.Display.DrawPolyline(pl,Color.Black,self.thick )
        if self.quadAxes:
            for axes in self.quadAxes:
                arg.Display.DrawLine(axes[0],Color.Red,self.thick)
                arg.Display.DrawLine(axes[1],Color.FromArgb(255,0,120,255),self.thick)
# ---------- end dt ----------

# ---- group: Make Form Finding Goals
subdmesh_4 = Mesh(subdmesh_2)
height = Panel("10")
warpweft = WarpWeft(Mesh=subdmesh_4)  # -> Warp, Weft, NakedA, NakedB
number_slider_2 = Slider(0.17, range=0..1)
number_slider_3 = Slider(0.719, range=0..1)
Z = UnitZ(Factor=height)
panel = Panel("0")

# ---- group: Make Form Finding Goals / identify boundaries
medges = MeshEdges(Mesh=subdmesh_4)  # -> NakedEdges, InteriorEdges, NonManifoldEdges
join = JoinCurves(Curves=medges.NakedEdges, Preserve=False)
len = Length(Curve=join)
sort = SortList(Keys=len, ValuesA=join)  # -> Keys, reverse(ValuesA)
split = SplitList(List=sort.ValuesA, Index=1)  # -> ListA, ListB

# ----
data = Data(warpweft.Warp)

# ---- group: Make Form Finding Goals (continued)
explode = Explode(Curve=split.ListB, Recursive=True)  # -> Segments, Vertices
explode_2 = Explode(Curve=split.ListA, Recursive=True)  # -> Segments, Vertices
end = EndPoints(Curve=explode.Segments)  # -> Start, End
end_2 = EndPoints(Curve=explode_2.Segments)  # -> Start, End
move = Move(Geometry=end_2.Start, Motion=Z)  # -> Geometry, Transform
fcircle = CircleFit(Points=end.Start)  # -> Circle, Radius, Deviation

show = Show(G=subdmesh_4)
anchor = Anchor(Point=end_2.Start, Target=move.Geometry, Strength=10000)
oncurve = OnCurve(Points=end.Start, Curve=fcircle.Circle, Strength=100)
length_line = LengthLine(Line=warpweft.Warp, Length=panel, Strength=number_slider_3)
length_line_2 = LengthLine(Line=warpweft.Weft, Length=panel, Strength=number_slider_2)

entwine = Entwine(Branch00=show, Branch01=[anchor, oncurve, length_line, length_line_2], FlattenInputs=True)

# ---- group: Solv Goals
reset = Button()
run = BooleanToggle(True)
solver = Solver(GoalObjects=entwine, Reset=reset, Threshold=1e-15, Tolerance=0.01, On=run)  # -> I, V, O
bang = ExplodeTree(Data=solver.O)  # -> Branch0, Branch1
mesh = Mesh(bang.Branch0)

# ----
subdmesh_5 = Mesh(mesh)

# ---- group: Extract UV and Perimeter Cables
# Extract Geometry From Form Found Mesh
toggle = BooleanToggle(True)
subdmesh_6 = Mesh(subdmesh_5)
subdmaps = Data(mgq.SubDMaps)
smtp = SubDMapsToPolylines(Toggle=toggle, SubDMesh=subdmesh_6, SubDMaps=subdmaps)  # -> UDirection, VDirection, Perimeters; inputs SubDMaps: list
# ---------- smtp: Python ----------
"""
Extract polylines in the UV directions and Perimeter of the SubDMaps
    Inputs:
        Toggle: {item,bool}
        CullPerimeter: Culls UV cables that sit on the Perimeter {item,bool}
        SubDMesh: {item,mesh}
        SubDMaps: {list,dict}
    Outputs:
        UDirection:
        VDirection:
        Perimeters:
    Remarks:
        Author: Anders Holden Deleuran
        License: Apache License 2.0
        Rhino: 6.17.19204.4491
        Version: 200917
"""

import Rhino as rc

ghenv.Component.Name = "SubDMapsToPolylines"
ghenv.Component.NickName = "SMTP"

def chunks(l,n):
    
    """ split l into n-sized chunks """
    
    for i in range(0,len(l),n):
        yield l[i:i+n]

def makeUVPolylinesFromSubdMap(macroVertices,subdMap):
    
    # Get UV subdivision counts and vertex map
    u = subdMap["uv"][0]
    v = subdMap["uv"][1]
    vtsMap = subdMap["vtsMap"]
    
    # Get subd vertices and structure into UV directions
    vts = [macroVertices[vtsID] for vtsID in vtsMap]
    vDirVts = list(chunks(vts,v+1))
    uDirVts = zip(*vDirVts)
    
    # Make cables
    uDirCables = [rc.Geometry.Polyline(vts) for vts in uDirVts]
    vDirCables = [rc.Geometry.Polyline(vts) for vts in vDirVts]
    
    return uDirCables,vDirCables

def getNakedPerimeters(mesh):
    
    """ Get naked edgeloops polylines and their vertices """
    
    polylines  = mesh.GetNakedEdges()
    flatVertices = rc.Collections.Point3dList()
    for pl in polylines:
        flatVertices.AddRange(pl)
        
    return polylines,flatVertices

def cullCablesOnPerimeters(cables,perimeterVts,tol):
    
    keptCables = []
    for pl in cables:
        plPt = pl[1]
        clId = perimeterVts.ClosestIndex(plPt)
        if perimeterVts[clId].DistanceTo(plPt) >= tol:
            keptCables.append(pl)
        
    return keptCables

if Toggle and SubDMesh and SubDMaps:
    
    # Get SubDMesh vertices
    macroVts = SubDMesh.Vertices.ToPoint3dArray()
    
    # Make UV cables from SubDMaps
    UDirection = []
    VDirection = []
    for sdm in SubDMaps:
        udc,vdc = makeUVPolylinesFromSubdMap(macroVts,sdm)
        UDirection.extend(udc)
        VDirection.extend(vdc)
        
    # Get naked perimeters
    Perimeters,perimeterVts = getNakedPerimeters(SubDMesh)
    
    # Cull cables on perimeter
    rhinoTol = rc.RhinoDoc.ActiveDoc.ModelAbsoluteTolerance
    UDirection = cullCablesOnPerimeters(UDirection,perimeterVts,rhinoTol)
    VDirection = cullCablesOnPerimeters(VDirection,perimeterVts,rhinoTol)
else:
    UDirection = []
    VDirection = []
    Perimeters = []
# ---------- end smtp ----------

# ---- group: Make NURBS Surfaces and Join These
subdmesh_7 = Mesh(subdmesh_5)
subdmaps_2 = Data(mgq.SubDMaps)
smts = SubDMapsToSurfaces(Toggle=Toggle(True), SubDMesh=subdmesh_7, SubDMaps=subdmaps_2)  # -> Breps; inputs SubDMaps: list
# ---------- smts: Python ----------
"""
Make NURBS surfaces for each SubDMaps on SubDMesh and join these to a Brep.
    Inputs:
        Toggle: {item,bool}
        JoinToBrep: {item,bool}
        SubDMesh: {item,mesh}
        SubDMaps: {list,dict}
    Outputs:
        Surfaces: 
    Remarks:
        Author: Anders Holden Deleuran
        License: Apache License 2.0
        Rhino: 6.17.19204.4491
        Version: 200917
"""

import Rhino as rc

ghenv.Component.Name = "SubDMapsToSurfaces"
ghenv.Component.NickName = "SMTS"

def makeSurfaceFromSubdMap(macroVertices,subdMap):
    
    # Get UV subdivision counts and vertex map
    u = subdMap["uv"][0]
    v = subdMap["uv"][1]
    vtsMap = subdMap["vtsMap"]
    
    # Get subd vertices
    vts = [macroVertices[vtsID] for vtsID in vtsMap]
    
    # Make the surface
    srf = rc.Geometry.NurbsSurface.CreateThroughPoints(vts,u+1,v+1,3,3,False,False)
    #srf = rc.Geometry.NurbsSurface.CreateFromPoints(vts,u+1,v+1,3,3)
    
    return srf

def joinSurfaces(surfaces):
    
    """ Cast surfaces to breps and join these, uses Rhino document tolerance """
    
    breps = [srf.ToBrep() for srf in surfaces]
    tol = rc.RhinoDoc.ActiveDoc.ModelAbsoluteTolerance
    jBreps = rc.Geometry.Brep.JoinBreps(breps,tol)
    
    return jBreps

if Toggle and SubDMesh and SubDMaps:
    
    # Get SubDMesh vertices
    macroVts = SubDMesh.Vertices.ToPoint3dArray()
    
    # Make surfaces from SubDMaps and attempt to join these
    surfaces = [makeSurfaceFromSubdMap(macroVts,sdm) for sdm in SubDMaps]
    breps = joinSurfaces(surfaces)
    
    # Output to GH
    Breps = breps
else:
    Breps = []
    SubDMesh = []
# ---------- end smts ----------

# ---- group: Draw Nurbs Surfaces
material = CreateMaterial(
    Diffuse=ColourSwatch(SwatchColor=RGB(255, 255, 255)),
    Specular=RGB(255, 255, 255),
    Emission=RGB(0, 0, 0),
    Transparency=Slider(0.45, range=0..1),
    Shine=Slider(11, range=0..100))
preview = CustomPreview(Geometry=smts, Material=material)

# ---- group: Draw Cable Network Directions
dc = DrawCables(UDirection=smtp.UDirection, VDirection=smtp.VDirection, Perimeters=smtp.Perimeters)  # inputs UDirection: list of Polyline, VDirection: list of Polyline, Perimeters: list of Polyline
# ---------- dc: Python ----------
"""
Draw Cable Network Directions.
    Inputs:
        UDirection: {list,polyline}
        VDirection: {list,polyline}
        Perimeters: {list,polyline}
    Outputs:
    Remarks:
        Author: Anders Holden Deleuran
        License: Apache License 2.0
        Rhino: 6.17.19204.4491
        Version: 200917
"""

from ghpythonlib.componentbase import executingcomponent as component
import Rhino as rc
from System.Drawing import Color

ghenv.Component.Name = "DrawCables"
ghenv.Component.NickName = "DC"

class MyComponent(component):
    
    def RunScript(self,UDirection,VDirection,Perimeters):
        
        self.weight = 2
        self.uDir = UDirection
        self.vDir = VDirection
        self.perim = Perimeters
        
    def DrawViewportWires(self,arg):
        
        if self.uDir:
            for crv in self.uDir:
                arg.Display.DrawPolyline(crv,Color.Red,self.weight)
                
        if self.vDir:
            for crv in self.vDir:
                arg.Display.DrawPolyline(crv,Color.FromArgb(255,0,120,255),self.weight)
                
        if self.perim:
            for crv in self.perim:
                arg.Display.DrawPolyline(crv,Color.Black,self.weight)
# ---------- end dc ----------
