# Grasshopper definition bending_membrane_edge Length(Line) Angle.gh (Grasshopper 1.0.7)
# plug-ins: Kangaroo2 Components

mplane = MeshPlane(Boundary={Plane=PlaneXY(0, 0, 0), Size=Domain2(u=-10..10, v=-10..10)}, WidthCount=10, HeightCount=10)  # -> Mesh, Area
tri = Triangulate(Mesh=mplane.Mesh)  # -> Mesh, Count
medges = MeshEdges(Mesh=tri.Mesh)  # -> NakedEdges, InteriorEdges, NonManifoldEdges
join = JoinCurves(Curves=medges.NakedEdges, Preserve=False)
explode = Explode(Curve=join, Recursive=True)  # -> Segments, Vertices
shift = ShiftList(List=explode.Segments, Shift=1, Wrap=True)

angle = Angle(LineA=explode.Segments, LineB=shift, RestAngle="0", Strength=2)
length_line = LengthLine(Line=medges.NakedEdges, Strength=Slider(100, range=0..100))
grab = Grab(On=True, Strength=1, Range=3)  # -> Grab, Anchors
length_line_2 = LengthLine(Line=medges.InteriorEdges, Length=Slider(1, range=0..1), Strength=Slider(0.01, range=0..0.01))

solver = Solver(GoalObjects=[length_line_2, length_line, angle, grab.Grab], Reset=Button(), Threshold=1e-15, Tolerance=0.01, On=True)  # -> I, V, O
