# Grasshopper definition ridge_cable Length(Line).gh (Grasshopper 1.0.7)
# plug-ins: Kangaroo2 Components

mesh = Mesh(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)
pt = Point([Point(1.512240038, 15, 10.67393147), Point(37.2167829, 15, 11.5883485)])
mc = MeshCorners(Mesh=mesh, Angle=2.35619449)
medges = MeshEdges(Mesh=mesh)  # -> NakedEdges, InteriorEdges, NonManifoldEdges
crv = Curve([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])
pt_2 = Point([Point(5, 15, 0), Point(35, 15, 0)])

anchor = Anchor(Point=pt_2, Target=pt, Strength=10000)
anchor_2 = Anchor(Point=mc, Strength=10000)
show = Show(G=mesh)
length_line = LengthLine(Line=medges.NakedEdges, Length=0, Strength=10)
length_line_2 = LengthLine(Line=medges.InteriorEdges, Length=0, Strength=Slider(0.77, range=0..1))
length_line_3 = LengthLine(Line=crv, Length=0, Strength=Slider(0, range=0..20))

entwine = Entwine(Branch00=show, Branch01=[anchor_2, length_line_2, length_line, anchor, length_line_3], FlattenInputs=True)
solver = Solver(GoalObjects=entwine, Reset=Button(), Threshold=1e-15, Tolerance=0.01, On=Toggle(True))  # -> I, V, O
item = ListItem(List=solver.O, Index=0, Wrap=True)
mesh_2 = Mesh(item)
