# Grasshopper definition tensile_cone OnCurve Length.gh (Grasshopper 1.0.7)
# plug-ins: Kangaroo2 Components

mesh = Mesh(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)
clean = CombineClean(Meshes=mesh)
refine = Refine(Mesh=clean, Level=Slider(3, range=0..11))
mesh_2 = Mesh(refine)
medges = MeshEdges(Mesh=mesh_2)  # -> NakedEdges, InteriorEdges, NonManifoldEdges
join = JoinCurves(Curves=medges.NakedEdges, Preserve=False)
item = ListItem(List=join, Index=0, Wrap=True)  # -> Item, Item1
crv = Curve(item.Item1)
explode = Explode(Curve=crv, Recursive=True)  # -> Segments, Vertices
end = EndPoints(Curve=explode.Segments)  # -> Start, End
pt = Point([Point(65, 20, 0), Point(65, 50, 0), Point(35, 50, 0), Point(35, 20, 0)])
crv_2 = Curve(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)

anchor = Anchor(Point=pt, Strength=10000)
length_line = LengthLine(Line=medges.NakedEdges, Length=Slider(0, range=0..1), Strength=Slider(10, range=0..10))
length_line_2 = LengthLine(Line=medges.InteriorEdges, Length=Slider(0, range=0..0.1), Strength=Slider(1, range=0..1))
oncurve = OnCurve(Points=end.Start, Curve=crv_2, Strength=Slider(6.455, range=0..201))

solver = Solver(
    GoalObjects=[anchor, length_line_2, length_line, oncurve],
    Reset=Button(),
    Threshold=1e-15,
    Tolerance=0.01,
    On=Toggle(False))  # -> I, V, O
data = Data(solver.O)
