# Grasshopper definition tensile_saddle Diagonalize Length(Line).gh (Grasshopper 1.0.7)
# plug-ins: Kangaroo2 Components

mesh = Mesh(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)
diag = Diagonalize(Mesh=mesh)
medges = MeshEdges(Mesh=diag)  # -> NakedEdges, InteriorEdges, NonManifoldEdges
mc = MeshCorners(Mesh=diag, Angle=2.35619449)
pt = Point([Point(5, 20, 6.997349412), Point(20, 20, 0), Point(20, 5, 8.103794634), Point(5, 5, 0)])

anchor = Anchor(Point=mc, Target=pt, Strength=10000)
length_line = LengthLine(Line=medges.InteriorEdges, Length=0, Strength=1)
length_line_2 = LengthLine(Line=medges.NakedEdges, Length=Slider(0.676, range=0..1), Strength=50)

solver = Solver(GoalObjects=[anchor, length_line, length_line_2], Reset=Button(), Threshold=1e-15, Tolerance=0.01, On=Toggle(False))  # -> I, V, O
