# Grasshopper definition tensile_tunnels OnCurve Length(Line).gh (Grasshopper 1.0.7)
# plug-ins: Kangaroo2 Components, Weaverbird

mesh = Mesh(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)
refine = Refine(Mesh=mesh, Level=Slider(1, range=0..10))
clean = CombineClean(Meshes=refine)
medges = MeshEdges(Mesh=clean)  # -> NakedEdges, InteriorEdges, NonManifoldEdges
join = JoinCurves(Curves=medges.NakedEdges, Preserve=False)
relay = Relay([medges.NakedEdges, medges.InteriorEdges])
item = ListItem(List=join, Index=0, Wrap=True)  # -> Item, Item1, Item2
explode = Explode(Curve=item.Item1, Recursive=True)  # -> Segments, Vertices
explode_2 = Explode(Curve=item.Item, Recursive=True)  # -> Segments, Vertices
explode_3 = Explode(Curve=item.Item2, Recursive=True)  # -> Segments, Vertices
number_slider = Slider(1100, range=0..1100)
end = EndPoints(Curve=explode.Segments)  # -> Start, End
end_2 = EndPoints(Curve=explode_2.Segments)  # -> Start, End
end_3 = EndPoints(Curve=explode_3.Segments)  # -> Start, End
crv = Curve(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)
crv_2 = Curve(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)
crv_3 = Curve(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)

show = Show(G=clean)
length_line = LengthLine(Line=relay, Length=Slider(0.3, range=0..2), Strength=1)
oncurve = OnCurve(Points=end_2.End, Curve=crv, Strength=number_slider)
oncurve_2 = OnCurve(Points=end.End, Curve=crv_2, Strength=number_slider)
oncurve_3 = OnCurve(Points=end_3.End, Curve=crv_3, Strength=number_slider)

solver = Solver(GoalObjects=[oncurve, oncurve_2, oncurve_3, length_line, show], Reset=Button(), Threshold=1e-15, Tolerance=0.01, On=True)  # -> I, V, O
item_2 = ListItem(List=solver.O, Index=0, Wrap=True)
mesh_2 = Mesh(item_2)
wbcatmullclark = WeaverbirdsCatmullClarkSubdivision(MeshCurves=mesh_2, Level=Slider(3, range=0..10), SmoothNakedEdges=1)
