# Grasshopper definition tensile_tunnels_warp_weft WarpWeft OnCurve Length(Line).gh (Grasshopper 1.0.7)
# plug-ins: Kangaroo2 Components, Weaverbird

mesh = Mesh(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)
refine = Refine(Mesh=mesh, Level=1)
clean = CombineClean(Meshes=refine)
medges = MeshEdges(Mesh=clean)  # -> NakedEdges, InteriorEdges, NonManifoldEdges
join = JoinCurves(Curves=medges.NakedEdges, Preserve=False)
item = ListItem(List=join, Index=0, Wrap=True)  # -> Item, Item1, Item2
explode = Explode(Curve=item.Item, Recursive=True)  # -> Segments, Vertices
explode_2 = Explode(Curve=item.Item1, Recursive=True)  # -> Segments, Vertices
explode_3 = Explode(Curve=item.Item2, Recursive=True)  # -> Segments, Vertices
warpweft = WarpWeft(Mesh=clean)  # -> Warp, Weft, NakedA, NakedB
end = EndPoints(Curve=explode.Segments)  # -> Start, End
end_2 = EndPoints(Curve=explode_3.Segments)  # -> Start, End
end_3 = EndPoints(Curve=explode_2.Segments)  # -> Start, End
crv = Curve(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)
crv_2 = Curve(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)
crv_3 = Curve(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)

length_line = LengthLine(Line=warpweft.Warp, Length="0", Strength=Slider(0.169, range=0..1))
length_line_2 = LengthLine(Line=warpweft.Weft, Length="0", Strength=Slider(0.29, range=0..1))
show = Show(G=clean)
oncurve = OnCurve(Points=end.End, Curve=crv_3, Strength="100")
oncurve_2 = OnCurve(Points=end_2.End, Curve=crv_2, Strength="100")
oncurve_3 = OnCurve(Points=end_3.End, Curve=crv, Strength="100")

solver = Solver(
    GoalObjects=[oncurve, oncurve_3, oncurve_2, show, length_line, length_line_2],
    Reset=Button(),
    Threshold=1e-15,
    Tolerance=0.01,
    On=True)  # -> I, V, O
item_2 = ListItem(List=solver.O, Index=0, Wrap=True)
mesh_2 = Mesh(item_2)
wbcatmullclark = WeaverbirdsCatmullClarkSubdivision(MeshCurves=mesh_2, Level=Slider(3, range=0..10), SmoothNakedEdges=1)
