# Grasshopper definition flag Wind.gh (Grasshopper 1.0.7)
# plug-ins: Kangaroo2 Components, NGon, Weaverbird, Heteroptera

number_slider = Slider(10, range=0..100)
number_slider_2 = Slider(49, range=0..100)
xz = XZPlane(Origin=Point(0, 0, 0))
range = Range(Domain=Slider(32, range=0..100), Steps=Slider(5, range=0..10))
rectangle = Rectangle(Plane=xz, XSize=number_slider_2, YSize=number_slider, Radius=0)  # -> Rectangle, Length
mplane = MeshPlane(Boundary=rectangle.Rectangle, WidthCount=number_slider_2, HeightCount=number_slider)  # -> Mesh, Area
Y = UnitY(Factor=range)
move = Move(Geometry=mplane.Mesh, Motion=Y)  # -> Geometry, Transform
noisemesh_displacement = NoiseOnMeshDisplacement(mesh=move.Geometry, S=1, T=0, D=1, R=0.5)
corners = Corners(Mesh=noisemesh_displacement, Angle=135)  # -> Corners, ID
item = ListItem(List=corners.Corners, Index=0, Wrap=True)  # -> Item, Item1, Item2, Item3
tri = Triangulate(Mesh=noisemesh_displacement)  # -> Mesh, Count
data = Data([item.Item2, item.Item])
lng = ListLength(List=tri.Mesh)
dom = ConstructDomain(DomainStart=Slider(0.02, range=0.01..0.18), DomainEnd=Slider(0.06, range=0.01..0.18))
medges = MeshEdges(Mesh=tri.Mesh)  # -> NakedEdges, InteriorEdges, NonManifoldEdges
randvect = RandomVectors(Number=flatten(lng), Length=dom, seed=226980)
pt = Point(data)

show = Show(G=noisemesh_displacement)
anchor = Anchor(Point=pt, Strength=10000)
length_line = LengthLine(Line=[medges.NakedEdges, medges.InteriorEdges], Length=Slider(1, range=0..1), Strength=10)
smooth = Smooth(M=tri.Mesh, Strength=1)
wind = Wind(Mesh=simplify(tri.Mesh), WindVector=simplify(randvect))

entwine = Entwine(Branch00=show, Branch01=[length_line, anchor, wind, smooth], FlattenInputs=True)
bouncysolver = BouncySolver(GoalObjects=entwine, Reset=Button(), Threshold=1e-15, Tolerance=0.01, Damping=0.99, Iterations=2, On=Toggle(False))  # -> I, V, O
data_2 = Data(bouncysolver.O)
dam = DataDam(DataA=data_2, BufferDelay=10000000, BufferMode=0)
clean = CleanTree(RemoveNulls=True, RemoveInvalid=True, RemoveEmpty=False, Tree=dam)
tmatch = MatchText(Text=clean, Pattern="Mesh*", Case=True)
cull = CullPattern(List=clean, CullPattern=tmatch)
wbcatmullclark = WeaverbirdsCatmullClarkSubdivision(MeshCurves=cull, Level=Slider(2, range=0..10), SmoothNakedEdges=1)
preview = CustomPreview(
    Geometry=wbcatmullclark,
    Material={diffuse=RGB(250, 250, 250), emission=RGB(0, 0, 0), shine=0, specular=RGB(255, 255, 255), transparency=0})

# ==== cluster NoiseOnMeshDisplacement: If you input mesh more than 1 piece, the seed will be automatically generated for each. Created By Quan Li with Nautilus Plugin
mesh = ClusterInput()
mesh_2 = Mesh(mesh)
lng = ListLength(List=mesh_2)
random = Random(Range=Domain(0, 100000), Number=lng, Seed=2)
equals = Equality(FirstNumber=lng, SecondNumber="1")  # -> Equality, Inequality
new_value = ClusterInput()
filter = StreamFilter(Gate=equals.Equality, Stream0=random, Stream1="1")
set_initial_value_of_a_cluster = InitialValueOfACluster(new_value=new_value, initial_value=filter)
R = ClusterInput()
S = ClusterInput()
D = ClusterInput()
T = ClusterInput()
num = Number(S)
num_2 = Number(set_initial_value_of_a_cluster)
num_3 = Number(T)
num_4 = Number(D)
num_5 = Number(R)
meshnoise = NoiseOnMesh(Mesh=mesh_2, Scale=S, Time=T, Details=D, Roughness=R, Seed=num_2)  # -> Mesh, OutputNoise
demesh = DeconstructMesh(Mesh=meshnoise.Mesh)  # -> Vertices, Faces, Colours, Normals
multiplication = Multiplication(A=demesh.Normals, B=meshnoise.OutputNoise)
move = Move(Geometry=demesh.Vertices, Motion=multiplication)  # -> Geometry, Transform
conmesh = ConstructMesh(Vertices=move.Geometry, Faces=demesh.Faces, Colours=demesh.Colours)
mesh_3 = Mesh(conmesh)
mesh_4 = ClusterOutput(mesh_3)

# ==== cluster InitialValueOfACluster: For adding a cluster initial values https://discourse.mcneel.com/t/how-to-set-initial-values-of-a-cluster/162514/2?u=quan_li
initial_value = ClusterInput()
new_value = ClusterInput()
new_value_2 = Data(new_value)
plane = NullItem(NewValue=new_value_2)  # -> NullFlags, InvalidFlags, Description
initial_value_2 = Data(initial_value)
filter = StreamFilter(Gate=plane.InvalidFlags, Stream0=new_value_2, Stream1=initial_value_2)
output = Data(filter)
output_2 = ClusterOutput(output)
